# Dynamo graph Criar_Valetas_Eixo_Saia_3m_V48.dyn (Dynamo 2.5.1.7586)
# V44 = V37 + tolerancia de encosto acompanhando o IN[10] + supressao do dissipador quando a saida cai sobre outra valeta do mesmo lado. Gera tambem o CSV _valetas_pacotes_debug.csv para diagnostico.

n1_nome_exato_do_alinhamento = StringInput("EIXO GO-188")  # "1. Nome exato do alinhamento"; graph input
n2_nome_exato_da_superficie = StringInput("TN_QA-210")  # "2. Nome exato da superficie"; graph input
file_path = Filename("Q:\QA-210_2025 (GO-188_AP Registro)\5.6.P.DRE\Auxiliares\taludes_NS-TER_GO-188.csv")
n4_distancia_de_analise_1_m = DoubleInput(3)  # "4. Distancia de analise 1 (m)"; graph input
n5_distancia_de_analise_2_m = DoubleInput(5)  # "5. Distancia de analise 2 (m)"; graph input
n6_distancia_de_analise_3_m = DoubleInput(10)  # "6. Distancia de analise 3 (m)"; graph input
n7_distancia_de_analise_4_m = DoubleInput(40)  # "7. Distancia de analise 4 (m)"; graph input
n8_distancia_de_analise_5_m = DoubleInput(70)  # "8. Distancia de analise 5 (m)"; graph input
n9_declividade_minima_para_agua = DoubleInput(0.5)  # "9. Declividade minima para agua indo a pista (%)"; graph input
n10_tolerancia_minima_do_sinal_de = DoubleInput(0.05)  # "10. Tolerancia minima do sinal de corte (m)"; graph input
n11_intervalo_maximo_para_unir = DoubleInput(25)  # "11. Intervalo maximo para unir pontos (m)"; graph input
n12_comprimento_minimo_da_valeta = DoubleInput(60)  # "12. Comprimento minimo da valeta (m)"; graph input
n13_distancia_da_saia_ate_a = DoubleInput(3)  # "13. Distancia da saia ate a valeta (m)"; graph input
n14_ruido_vertical_ignorado_no = DoubleInput(4)  # "14. Ruido vertical ignorado no caimento (m)"; graph input
n15_comprimento_maximo_de_ruido = DoubleInput(20)  # "15. Comprimento maximo de ruido pontual (m)"; graph input
n16_somente_nota_de_servico_true = BoolSelector(false)  # "16. Somente nota de servico (True = nao apaga/desenha)"; graph input
executar_analise_de_valetas = Python(IN[0]=n1_nome_exato_do_alinhamento, IN[1]=n2_nome_exato_da_superficie, IN[2]=file_path, IN[3]=n4_distancia_de_analise_1_m, IN[4]=n5_distancia_de_analise_2_m, IN[5]=n6_distancia_de_analise_3_m, IN[6]=n7_distancia_de_analise_4_m, IN[7]=n8_distancia_de_analise_5_m, IN[8]=n9_declividade_minima_para_agua, IN[9]=n10_tolerancia_minima_do_sinal_de, IN[10]=n11_intervalo_maximo_para_unir, IN[11]=n12_comprimento_minimo_da_valeta, IN[12]=n13_distancia_da_saia_ate_a, IN[13]=n14_ruido_vertical_ignorado_no, IN[14]=n15_comprimento_maximo_de_ruido, IN[15]=n16_somente_nota_de_servico_true)  # graph output
# ---------- executar_analise_de_valetas.python (2567 lines) ----------
# Analise generica de valetas de corte - Civil 3D 2021 / Dynamo 2.5
# IN[0] nome do alinhamento
# IN[1] nome da superficie
# IN[2] caminho completo do CSV de taludes
# IN[3..7] distancias de analise
# IN[8] declividade minima para agua indo para a pista (%)
# IN[9] tolerancia minima para considerar sinal de corte (m)
# IN[10] intervalo maximo para unir pontos (m)
# IN[11] comprimento minimo do trecho (m)
# IN[12] afastamento adicional para fora do encontro do talude (m)
# IN[13] ruido vertical maximo ignorado no caimento (m)
# IN[14] comprimento maximo de ruido pontual para absorver (m)
# IN[15] somente nota de servico (True = nao apaga/desenha, le as valetas ja existentes)

import csv
import os
import clr

clr.AddReference("AcMgd")
clr.AddReference("AcDbMgd")
clr.AddReference("AeccDbMgd")

from Autodesk.AutoCAD.ApplicationServices import Application
from Autodesk.AutoCAD.Colors import Color, ColorMethod
from Autodesk.AutoCAD.DatabaseServices import (
    BlockTable, BlockTableRecord, Circle, Hatch, HatchLoopTypes,
    HatchPatternType, LayerTable, LayerTableRecord, Line, LineWeight,
    ObjectIdCollection, OpenMode, Polyline
)
from Autodesk.AutoCAD.Geometry import Point2d, Point3d, Vector3d
from Autodesk.Civil.ApplicationServices import CivilApplication

ALIGNMENT_NAME = str(IN[0]).strip()
SURFACE_NAME = str(IN[1]).strip()
CSV_INPUT = str(IN[2]).strip().strip('"')
SAMPLE_DISTANCES = [float(IN[3]), float(IN[4]), float(IN[5]), float(IN[6]), float(IN[7])]
MIN_SLOPE_TO_ROAD_PCT = float(IN[8])
MIN_CUT_HEIGHT = float(IN[9])
MAX_STATION_GAP = float(IN[10])
MIN_SEGMENT_LENGTH = float(IN[11])
DITCH_EXTRA_OFFSET = float(IN[12])
VERTICAL_NOISE_TOL = float(IN[13])
NOISE_GAP_LENGTH = float(IN[14])
try:
    NOTA_ONLY = len(IN) > 15 and str(IN[15]).strip().upper() in ["TRUE", "1", "SIM", "S"]
except Exception:
    NOTA_ONLY = False
VALETA_WIDTH = 0.50
OUTLET_LENGTH = 7.0
DISS_LENGTH = 4.0
DISS_WIDTH = 1.5
LOW_POINT_SPLIT_GAP = 20.0
HIGH_POINT_SPLIT_GAP = 5.0
MIN_LOCAL_SEGMENT_LENGTH = 20.0
JOIN_VALETA_GAP = 60.0
MAX_OPPOSITE_TYPE_GAP = 40.0
PACKAGE_JOIN_MAX_DISTANCE = 40.0
# Distancia (m) de vazio entre a saida de um pacote e o inicio do proximo para
# considerar que eles "encostam" um no outro (vazao acumula direto, sem dissipador).
# O valor fixo de 18m assumia amostragem de ate 18m entre estacas. Num CSV de estaca
# cheia (20m), uma unica estaca de vazio entre dois pacotes ja estoura esse limite por
# 2m: o script entendia que o trecho terminava ali, desenhava o rabicho de saida mais
# o dissipador, e comecava outro pacote colado. Por isso a tolerancia passa a
# acompanhar o "intervalo maximo para unir pontos" (IN[10]): se dois pontos a essa
# distancia podem formar uma mesma valeta, dois pacotes a essa distancia tambem devem
# se conectar em vez de dissipar.
PACKAGE_TOUCH_TOLERANCE = 18.0
# V45: desnivel minimo (m) entre as pontas para decidir o sentido do caimento.
FLOW_DIRECTION_TOL = 0.05


def package_touch_tolerance():
    return max(PACKAGE_TOUCH_TOLERANCE, MAX_STATION_GAP)
FLOW_ARROW_LENGTH = 2.40
FLOW_ARROW_SPACING = 30.0
FLOW_TRACE_STEP = 2.0
FLOW_TRACE_MIN_DROP = 0.01
FLOW_TRACE_MAX_LENGTH = 80.0
FLOW_TRACE_CROSS_TOL = 0.50
FLOW_TRACE_CAPTURE_TOL = 3.50
WATERDROP_TOTAL_REQUIRED = 2
# Quanto o caminho pode subir (m) durante a busca do aterro de saida do corte, em
# relacao ao ponto mais baixo ja alcancado na caminhada. Pequenas ondulacoes de
# terreno sao toleradas, mas uma subida real interrompe a busca -- agua nao escoa
# ladeira acima, entao nao faz sentido conectar a um aterro que so existe subindo.
CUT_EXTENSION_CLIMB_TOL = 0.50
FLOW_TRACE_DIRS = [
    (-1.0, 0.0), (1.0, 0.0), (0.0, -1.0), (0.0, 1.0),
    (-0.70710678, -0.70710678), (-0.70710678, 0.70710678),
    (0.70710678, -0.70710678), (0.70710678, 0.70710678),
]
ELEVATION_CACHE = {}


def parse_number(text):
    if text is None:
        return 0.0
    value = str(text).strip()
    if value == "":
        return 0.0
    if "," in value:
        value = value.replace(".", "").replace(",", ".")
    return float(value)


def fmt(value, digits=3):
    if value is None:
        return ""
    return (("{0:." + str(digits) + "f}").format(float(value))).replace(".", ",")


def station_offset_point(alignment, station, signed_offset):
    x = clr.Reference[float]()
    y = clr.Reference[float]()
    alignment.PointLocation(float(station), float(signed_offset), x, y)
    return float(x.Value), float(y.Value)


def offset_outward_sign(signed_offset):
    if float(signed_offset) < 0.0:
        return -1.0
    return 1.0


def point_with_axis_reference(alignment, surface, station, signed_offset):
    axis_x, axis_y = station_offset_point(alignment, station, 0.0)
    x, y = station_offset_point(alignment, station, signed_offset)
    z = elevation(surface, x, y)
    away_x, away_y = unit_xy(x - axis_x, y - axis_y)
    return {
        "x": x, "y": y, "z": z,
        "axis_x": axis_x, "axis_y": axis_y,
        "away_x": away_x, "away_y": away_y,
    }


def elevation(surface, x, y):
    return float(surface.FindElevationAtXY(float(x), float(y)))


def cached_elevation(surface, x, y):
    key = (round(float(x), 3), round(float(y), 3))
    if key in ELEVATION_CACHE:
        return ELEVATION_CACHE[key]
    try:
        value = elevation(surface, x, y)
    except Exception:
        value = None
    ELEVATION_CACHE[key] = value
    return value


def distance_to_skirt(point, skirt_point):
    # Distancia euclidiana real ate o ponto da saia (nao projecao numa reta fixa).
    # Uma projecao na direcao "para fora" calculada so no ponto inicial pode dar falso
    # positivo em trecho curvo do alinhamento: a agua pode se afastar de verdade da
    # rodovia e mesmo assim "cruzar" a reta projetada por causa da curvatura. Medindo
    # a distancia real ate o ponto da saia, so conta como capturada a agua que de fato
    # chegou perto do corpo do talude, nao qualquer agua que cruzou uma reta imaginaria.
    return (
        (point["x"] - skirt_point["x"]) ** 2 +
        (point["y"] - skirt_point["y"]) ** 2
    ) ** 0.5


def steepest_descent_neighbor(surface, point):
    current_z = point.get("z")
    if current_z is None:
        current_z = cached_elevation(surface, point["x"], point["y"])
    if current_z is None:
        return None, 0.0
    best = None
    best_drop = 0.0
    for dx, dy in FLOW_TRACE_DIRS:
        nx = point["x"] + dx * FLOW_TRACE_STEP
        ny = point["y"] + dy * FLOW_TRACE_STEP
        nz = cached_elevation(surface, nx, ny)
        if nz is None:
            continue
        drop = current_z - nz
        if drop > best_drop:
            best_drop = drop
            best = {"x": nx, "y": ny, "z": nz}
    return best, best_drop


def trace_waterdrop_to_skirt(surface, start_point, skirt_point):
    if start_point is None or skirt_point is None:
        return {"crossed": None, "path_length": 0.0, "min_distance": None}
    if start_point.get("x") is None or start_point.get("y") is None or start_point.get("z") is None:
        return {"crossed": None, "path_length": 0.0, "min_distance": None}
    current = {"x": start_point["x"], "y": start_point["y"], "z": start_point["z"]}
    current_distance = distance_to_skirt(current, skirt_point)
    min_distance = current_distance
    path_length = 0.0
    if current_distance <= FLOW_TRACE_CROSS_TOL:
        return {"crossed": True, "path_length": path_length, "min_distance": min_distance}
    max_steps = int(FLOW_TRACE_MAX_LENGTH / FLOW_TRACE_STEP) + 2
    for _ in range(max_steps):
        neighbor, best_drop = steepest_descent_neighbor(surface, current)
        if neighbor is None or best_drop < FLOW_TRACE_MIN_DROP:
            break
        next_distance = distance_to_skirt(neighbor, skirt_point)
        path_length += ((neighbor["x"] - current["x"]) ** 2 + (neighbor["y"] - current["y"]) ** 2) ** 0.5
        min_distance = min(min_distance, next_distance)
        if next_distance <= FLOW_TRACE_CROSS_TOL:
            return {"crossed": True, "path_length": path_length, "min_distance": min_distance}
        current = neighbor
        current_distance = next_distance
        if path_length >= FLOW_TRACE_MAX_LENGTH:
            break
    return {"crossed": False, "path_length": path_length, "min_distance": min_distance}


def waterdrop_sample_result(alignment, surface, station, skirt_offset, outward_sign, distance, skirt_point):
    try:
        start_point = point_with_axis_reference(
            alignment, surface, station,
            skirt_offset + outward_sign * distance
        )
    except Exception:
        return {
            "crossed": None,
            "label": "SEM_DADO",
            "distance": distance,
            "path_length": 0.0,
            "min_distance": None,
        }
    trace = trace_waterdrop_to_skirt(surface, start_point, skirt_point)
    crossed = trace["crossed"]
    near_capture = False
    if crossed is False and distance > FLOW_TRACE_CAPTURE_TOL:
        min_distance = trace.get("min_distance")
        near_capture = min_distance is not None and min_distance <= FLOW_TRACE_CAPTURE_TOL
    positive = bool(crossed) or near_capture
    if crossed is None:
        label = "SEM_DADO"
    elif crossed:
        label = "CRUZOU"
    elif near_capture:
        label = "PERTO"
    else:
        label = "NAO"
    trace["positive"] = positive
    trace["near_capture"] = near_capture
    trace["label"] = label
    trace["distance"] = distance
    return trace


def waterdrop_to_road(alignment, surface, station, skirt_offset, skirt_point):
    outward_sign = offset_outward_sign(skirt_offset)
    results = []
    short_valid = 0
    short_hits = 0
    total_valid = 0
    total_hits = 0
    for index, distance in enumerate(SAMPLE_DISTANCES):
        result = waterdrop_sample_result(
            alignment, surface, station, skirt_offset,
            outward_sign, distance, skirt_point
        )
        results.append(result)
        if result["crossed"] is not None:
            total_valid += 1
            if result["positive"]:
                total_hits += 1
        if index < 3 and result["crossed"] is not None:
            short_valid += 1
            if result["positive"]:
                short_hits += 1
    if total_valid < 3:
        return None, results, short_hits, short_valid, total_hits, total_valid
    return total_hits >= WATERDROP_TOTAL_REQUIRED, results, short_hits, short_valid, total_hits, total_valid


def read_latest_rows(path):
    latest = {}
    with open(path, "rb") as stream:
        reader = csv.DictReader(stream, delimiter=";")
        # CSVs UTF-8 gerados para Excel podem iniciar com BOM. No IronPython
        # essa marca aparece como parte invisivel do primeiro cabecalho.
        reader.fieldnames = [
            str(name).lstrip("\xef\xbb\xbf").lstrip(u"\ufeff").strip()
            for name in reader.fieldnames
        ]
        required = ["estaca_m", "offset_le", "le", "ld", "offset_ld"]
        missing = [name for name in required if name not in reader.fieldnames]
        if missing:
            raise Exception("Colunas ausentes no CSV: " + ", ".join(missing))
        for row in reader:
            station = parse_number(row.get("estaca_m"))
            latest[station] = row
    return [latest[key] for key in sorted(latest.keys())]


def group_candidates(profile, target_decision):
    groups = []
    current = []
    for item in sorted(profile, key=lambda candidate: candidate["station"]):
        approved = item.get("decision") == target_decision
        continuous = (
            current and
            item["station"] - current[-1]["station"] <= MAX_STATION_GAP
        )
        if approved and (not current or continuous):
            current.append(item)
        else:
            if len(current) >= 2 and current[-1]["station"] - current[0]["station"] >= MIN_SEGMENT_LENGTH:
                groups.append(current)
            current = [item] if approved else []
    if len(current) >= 2 and current[-1]["station"] - current[0]["station"] >= MIN_SEGMENT_LENGTH:
        groups.append(current)
    return groups


def extend_groups_to_downstream_aterro(groups, profiles):
    packages = []
    ordered = sorted(profiles, key=lambda item: item["station"])
    for group in groups:
        flow_forward = group[-1]["z"] < group[0]["z"]
        if flow_forward:
            candidates = [item for item in ordered if item["station"] > group[-1]["station"]]
        else:
            candidates = [item for item in reversed(ordered) if item["station"] < group[0]["station"]]

        additions = []
        found_aterro = False
        for item in candidates:
            if item.get("x") is None:
                continue
            if item["height"] > MIN_CUT_HEIGHT:
                additions.append(item)
                found_aterro = True
                break
            additions.append(item)

        cut_result = list(group)
        fill_extension = []
        outlet = None
        if found_aterro:
            outlet = additions[-1]
            previous = additions[-2] if len(additions) > 1 else (group[-1] if flow_forward else group[0])
            denominator = outlet["height"] - previous["height"]
            ratio = 1.0 if abs(denominator) < 1e-9 else (-previous["height"] / denominator)
            ratio = max(0.0, min(1.0, ratio))
            transition = {
                "station": previous["station"] + (outlet["station"] - previous["station"]) * ratio,
                "x": previous["x"] + (outlet["x"] - previous["x"]) * ratio,
                "y": previous["y"] + (outlet["y"] - previous["y"]) * ratio,
                "z": previous["z"] + (outlet["z"] - previous["z"]) * ratio,
                "height": 0.0,
                "decision": "TRANSICAO",
            }
            negative_extension = additions[:-1]
            cut_result = sorted(group + negative_extension + [transition], key=lambda item: item["station"])
            fill_extension = sorted([transition, outlet], key=lambda item: item["station"])
        packages.append({
            "cut": cut_result,
            "fill_extension": fill_extension,
            "outlet": outlet,
        })
    return packages


def fill_groups_to_packages(groups):
    packages = []
    for group in groups:
        outlet = group[0] if group[0]["z"] <= group[-1]["z"] else group[-1]
        packages.append({
            "cut": [],
            "fill_extension": group,
            "outlet": outlet,
        })
    return packages


def group_any_valeta(profile):
    groups = []
    current = []
    gap_span = 0.0
    for item in sorted(profile, key=lambda candidate: candidate["station"]):
        approved = item.get("decision") in ["CRIAR_VALETA_CORTE", "CRIAR_VALETA_ATERRO"]
        gap = item["station"] - current[-1]["station"] if current else 0.0
        if approved and (not current or gap <= JOIN_VALETA_GAP):
            current.append(item)
            gap_span = 0.0
        elif (not approved) and current and gap <= MAX_STATION_GAP and gap_span + gap <= JOIN_VALETA_GAP:
            current.append(item)
            gap_span += gap
        else:
            if len(current) >= 2:
                groups.append(current)
            current = [item] if approved else []
            gap_span = 0.0
    if len(current) >= 2:
        groups.append(current)
    return groups


def item_type(item):
    # Na planilha do talude, positivo representa aterro e negativo representa corte.
    if item["height"] > MIN_CUT_HEIGHT:
        return "ATERRO"
    if item["height"] < -MIN_CUT_HEIGHT:
        return "CORTE"
    return None


def decision_for_segment_type(segment_type):
    if segment_type == "CORTE":
        return "CRIAR_VALETA_CORTE"
    if segment_type == "ATERRO":
        return "CRIAR_VALETA_ATERRO"
    return None


def segment_has_direct_support(points, segment_type):
    target = decision_for_segment_type(segment_type)
    if target is None:
        return False
    return any(item.get("decision") == target for item in points)


def package_first_point(package):
    best = None
    for segment in package.get("segments", []):
        for point in segment.get("points", []):
            if point.get("x") is None or point.get("y") is None or point.get("z") is None:
                continue
            if best is None or point["station"] < best["station"]:
                best = point
    return best


def package_last_point(package):
    best = None
    for segment in package.get("segments", []):
        for point in segment.get("points", []):
            if point.get("x") is None or point.get("y") is None or point.get("z") is None:
                continue
            if best is None or point["station"] > best["station"]:
                best = point
    return best


def segment_touches_outlet(segment_points, outlet):
    if outlet is None or not segment_points:
        return False
    segment_outlet = downstream_end_by_ends(segment_points)
    if segment_outlet is None:
        return False
    if xy_distance(segment_outlet, outlet) <= max(0.75, VALETA_WIDTH * 2.0):
        return True
    return abs(float(segment_outlet.get("station", 0.0)) - float(outlet.get("station", 0.0))) <= 0.05


def first_approved_type(points):
    for item in points:
        decision = item.get("decision")
        if decision == "CRIAR_VALETA_CORTE":
            return "CORTE"
        if decision == "CRIAR_VALETA_ATERRO":
            return "ATERRO"
    for item in points:
        value = item_type(item)
        if value is not None:
            return value
    return None


def split_by_opposite_type_gap(points, base_type):
    if base_type is None:
        return [points]
    result = []
    current = []
    opposite = []
    for item in sorted(points, key=lambda candidate: candidate["station"]):
        value = item_type(item)
        is_opposite = value is not None and value != base_type
        if is_opposite:
            opposite.append(item)
            continue
        if opposite:
            span = opposite[-1]["station"] - opposite[0]["station"] if len(opposite) > 1 else 0.0
            if span <= MAX_OPPOSITE_TYPE_GAP:
                current.extend(opposite)
            else:
                if len(current) >= 2 and current[-1]["station"] - current[0]["station"] >= MIN_LOCAL_SEGMENT_LENGTH:
                    result.append(current)
                current = []
            opposite = []
        current.append(item)
    if opposite and current:
        span = opposite[-1]["station"] - opposite[0]["station"] if len(opposite) > 1 else 0.0
        if span <= MAX_OPPOSITE_TYPE_GAP:
            current.extend(opposite)
    if len(current) >= 2 and current[-1]["station"] - current[0]["station"] >= MIN_LOCAL_SEGMENT_LENGTH:
        result.append(current)
    return result if result else []


def dominant_approved_type(points):
    lengths = {"CORTE": 0.0, "ATERRO": 0.0}
    ordered = sorted(points, key=lambda candidate: candidate["station"])
    for index, item in enumerate(ordered):
        value = item_type(item)
        if value is None:
            continue
        if index + 1 < len(ordered):
            delta = max(0.0, ordered[index + 1]["station"] - item["station"])
        elif index > 0:
            delta = max(0.0, item["station"] - ordered[index - 1]["station"])
        else:
            delta = 0.0
        lengths[value] += delta
    if lengths["CORTE"] > lengths["ATERRO"]:
        return "CORTE"
    if lengths["ATERRO"] > lengths["CORTE"]:
        return "ATERRO"
    return first_approved_type(points)


def transition_between(a, b):
    denominator = b["height"] - a["height"]
    ratio = 0.5 if abs(denominator) < 1e-9 else (-a["height"] / denominator)
    ratio = max(0.0, min(1.0, ratio))
    transition = {
        "station": a["station"] + (b["station"] - a["station"]) * ratio,
        "x": a["x"] + (b["x"] - a["x"]) * ratio,
        "y": a["y"] + (b["y"] - a["y"]) * ratio,
        "z": a["z"] + (b["z"] - a["z"]) * ratio,
        "height": 0.0,
        "decision": "TRANSICAO",
    }
    for key in ["axis_x", "axis_y", "away_x", "away_y"]:
        if a.get(key) is not None and b.get(key) is not None:
            transition[key] = a[key] + (b[key] - a[key]) * ratio
    return transition


def interpolate_between(a, b, station):
    denominator = b["station"] - a["station"]
    ratio = 0.0 if abs(denominator) < 1e-9 else (station - a["station"]) / denominator
    ratio = max(0.0, min(1.0, ratio))
    point = {
        "station": a["station"] + (b["station"] - a["station"]) * ratio,
        "x": a["x"] + (b["x"] - a["x"]) * ratio,
        "y": a["y"] + (b["y"] - a["y"]) * ratio,
        "z": a["z"] + (b["z"] - a["z"]) * ratio,
        "height": a["height"] + (b["height"] - a["height"]) * ratio,
        "decision": a.get("decision", "INTERPOLADO"),
    }
    for key in ["axis_x", "axis_y", "away_x", "away_y"]:
        if a.get(key) is not None and b.get(key) is not None:
            point[key] = a[key] + (b[key] - a[key]) * ratio
    return point


def point_at_station(points, station):
    if not points:
        return None
    ordered = sorted(points, key=lambda item: item["station"])
    if station <= ordered[0]["station"]:
        return ordered[0]
    if station >= ordered[-1]["station"]:
        return ordered[-1]
    for index in range(1, len(ordered)):
        previous = ordered[index - 1]
        item = ordered[index]
        if previous["station"] <= station <= item["station"]:
            return interpolate_between(previous, item, station)
    return None


def crossing_station(a, b, target_z):
    denominator = b["z"] - a["z"]
    ratio = 0.5 if abs(denominator) < 1e-9 else (target_z - a["z"]) / denominator
    ratio = max(0.0, min(1.0, ratio))
    return a["station"] + (b["station"] - a["station"]) * ratio


def internal_break_candidate(points, index, kind):
    if index <= 0 or index >= len(points) - 1:
        return None
    point = points[index]
    if kind == "HIGH":
        amplitude = point["z"] - max(points[0]["z"], points[-1]["z"])
        if amplitude <= VERTICAL_NOISE_TOL:
            return None
        threshold = point["z"] - VERTICAL_NOISE_TOL
        comparator = lambda item: item["z"] <= threshold
    else:
        amplitude = min(points[0]["z"], points[-1]["z"]) - point["z"]
        if amplitude <= VERTICAL_NOISE_TOL:
            return None
        threshold = point["z"] + VERTICAL_NOISE_TOL
        comparator = lambda item: item["z"] >= threshold

    left_station = points[0]["station"]
    right_station = points[-1]["station"]

    for scan in range(index - 1, -1, -1):
        if comparator(points[scan]):
            left_station = crossing_station(points[scan], points[scan + 1], threshold)
            break

    for scan in range(index + 1, len(points)):
        if comparator(points[scan]):
            right_station = crossing_station(points[scan - 1], points[scan], threshold)
            break

    left_span = max(0.0, point["station"] - left_station)
    right_span = max(0.0, right_station - point["station"])
    support_span = max(0.0, right_station - left_station)
    # Um espigao curto com um lado muito pequeno ainda e ruido local,
    # mesmo se o outro lado se prolongar bastante ao longo da valeta.
    if (
        support_span <= NOISE_GAP_LENGTH or
        min(left_span, right_span) <= (NOISE_GAP_LENGTH / 2.0)
    ):
        return None
    return {
        "point": point,
        "amplitude": amplitude,
        "support_span": support_span,
        "left_span": left_span,
        "right_span": right_span,
        "kind": kind,
    }


def split_at_internal_grade_break(group):
    # Nesta versao a continuidade hidraulica da valeta prevalece sobre
    # tentativas de dividir o trecho por extremos locais de terreno.
    return [group]


def split_group_by_sign(group):
    group = [
        item for item in group
        if item.get("x") is not None and item.get("y") is not None and item.get("z") is not None
    ]
    if len(group) < 2:
        return []
    segments = []
    current_type = item_type(group[0])
    current = [group[0]]
    for index in range(1, len(group)):
        previous = group[index - 1]
        item = group[index]
        next_type = item_type(item)
        if next_type is None:
            continue
        if current_type is None:
            current_type = next_type
            current = [item]
        elif next_type == current_type:
            current.append(item)
        else:
            transition = transition_between(previous, item)
            current.append(transition)
            if len(current) >= 2:
                segments.append({"type": current_type, "points": list(current)})
            current_type = next_type
            current = [transition, item]
    if current_type is not None and len(current) >= 2:
        segments.append({"type": current_type, "points": current})
    return segments


def segment_station_span(points):
    if len(points) < 2:
        return 0.0
    return abs(points[-1]["station"] - points[0]["station"])


def merge_segment_points(segments):
    merged = []
    for segment in segments:
        for point in segment["points"]:
            if not merged or abs(point["station"] - merged[-1]["station"]) > 1e-6:
                merged.append(point)
    return merged


def valid_profile_points(profile):
    return [
        item for item in sorted(profile, key=lambda point: point["station"])
        if item.get("x") is not None and item.get("y") is not None and item.get("z") is not None
    ]


def build_profile_points_between(profile, start_station, end_station):
    if end_station <= start_station:
        return []
    ordered = valid_profile_points(profile)
    if len(ordered) < 2:
        return []
    start_point = point_at_station(ordered, start_station)
    end_point = point_at_station(ordered, end_station)
    if start_point is None or end_point is None:
        return []
    result = [start_point]
    for item in ordered:
        if start_station < item["station"] < end_station:
            result.append(item)
    if abs(result[-1]["station"] - end_point["station"]) > 1e-6:
        result.append(end_point)
    return result


def absorb_short_internal_opposites(segments):
    collapsed = list(segments)
    changed = True
    while changed and len(collapsed) >= 3:
        changed = False
        index = 1
        while index < len(collapsed) - 1:
            previous = collapsed[index - 1]
            current = collapsed[index]
            following = collapsed[index + 1]
            if (
                previous["type"] == following["type"] and
                current["type"] != previous["type"] and
                segment_station_span(current["points"]) <= MAX_OPPOSITE_TYPE_GAP
            ):
                merged_points = merge_segment_points([previous, current, following])
                collapsed[index - 1:index + 2] = [{
                    "type": previous["type"],
                    "points": merged_points,
                }]
                changed = True
                break
            index += 1
    return collapsed


def merge_nearby_packages(packages, profile):
    if not packages:
        return []
    ordered_packages = sorted(
        packages,
        key=lambda package: package_station_range(package)[0] if package_station_range(package) is not None else 0.0
    )
    merged = [ordered_packages[0]]
    for package in ordered_packages[1:]:
        previous = merged[-1]
        prev_range = package_station_range(previous)
        curr_range = package_station_range(package)
        if prev_range is None or curr_range is None:
            merged.append(package)
            continue
        prev_last = previous["segments"][-1]
        curr_first = package["segments"][0]
        prev_end_point = prev_last["points"][-1]
        curr_start_point = curr_first["points"][0]
        gap = curr_range[0] - prev_range[1]
        join_distance = xy_distance(prev_end_point, curr_start_point)
        if prev_end_point.get("z") is None or curr_start_point.get("z") is None:
            delta_z = 1e12
        else:
            delta_z = abs(curr_start_point["z"] - prev_end_point["z"])
        close_enough = (
            gap <= PACKAGE_JOIN_MAX_DISTANCE and
            join_distance <= PACKAGE_JOIN_MAX_DISTANCE and
            delta_z <= VERTICAL_NOISE_TOL
        )
        can_merge = (
            close_enough and
            package_primary_type(previous) == package_primary_type(package)
        )
        if not can_merge:
            merged.append(package)
            continue
        rebuilt = finalize_package_range(
            profile,
            min(prev_range[0], curr_range[0]),
            max(prev_range[1], curr_range[1]),
        )
        if rebuilt is None:
            merged.append(package)
            continue
        merged[-1] = rebuilt
    return merged


def extend_cut_until_first_fill(group, profile):
    if not group:
        return list(group), None
    outlet = downstream_end_by_ends(group)
    if item_type(outlet) != "CORTE":
        return list(group), outlet
    ordered = [
        item for item in sorted(profile, key=lambda candidate: candidate["station"])
        if item.get("x") is not None and item.get("y") is not None and item.get("z") is not None
    ]
    if len(ordered) < 2:
        return list(group), None
    group_start = group[0]["station"]
    group_end = group[-1]["station"]
    forward = abs(outlet["station"] - group_end) <= abs(outlet["station"] - group_start)
    if forward:
        candidates = [item for item in ordered if item["station"] > outlet["station"]]
    else:
        candidates = [item for item in reversed(ordered) if item["station"] < outlet["station"]]
    additions = []
    last_station = outlet["station"]
    found_fill = None
    lowest_z = outlet["z"]
    for item in candidates:
        if item["z"] > lowest_z + CUT_EXTENSION_CLIMB_TOL:
            # O caminho comecou a subir de verdade a partir do ponto mais baixo ja
            # alcancado -- nao ha escoamento por gravidade nesse sentido, entao para
            # de procurar aterro aqui (mesmo que exista um aterro confirmado mais
            # adiante, ele nao e alcancavel ladeira acima).
            break
        lowest_z = min(lowest_z, item["z"])
        additions.append(item)
        last_station = item["station"]
        # So aceita como aterro de saida um ponto onde a agua foi de fato confirmada
        # indo para a pista (decision == CRIAR_VALETA_ATERRO). Um ponto isolado com
        # altura positiva mas sem agua comprovada (DISPENSAR_VALETA) e ruido de secao,
        # nao um aterro real onde a valeta pode desaguar.
        if item_type(item) == "ATERRO" and item.get("decision") == "CRIAR_VALETA_ATERRO":
            found_fill = item
            break
    if found_fill is None:
        return list(group), None
    return sorted(group + additions, key=lambda candidate: candidate["station"]), found_fill


def finalize_package_segments(segments, profile):
    segments = [
        segment for segment in segments
        if len(segment.get("points", [])) >= 2
    ]
    if not segments:
        return None
    package_points = merge_segment_points(segments)
    outlet = downstream_end_by_ends(package_points)
    outlet_type = item_type(outlet) if outlet is not None else None
    if outlet_type is None:
        outlet_type = segments[-1]["type"]
    if outlet_type == "CORTE":
        extended_points, found_fill = extend_cut_until_first_fill(package_points, profile)
        if found_fill is not None and len(extended_points) >= 2:
            forced_segments = split_group_by_sign(extended_points)
            forced_segments = absorb_short_internal_opposites(forced_segments)
            forced_segments = [
                segment for segment in forced_segments
                if len(segment.get("points", [])) >= 2
            ]
            if forced_segments:
                segments = forced_segments
                package_points = merge_segment_points(segments)
                outlet = downstream_end_by_ends(package_points)
                outlet_type = item_type(outlet) if outlet is not None else None
                if outlet_type is None:
                    outlet_type = segments[-1]["type"]
    return {
        "segments": segments,
        "outlet": outlet,
        "outlet_type": outlet_type,
    }


def finalize_package_range(profile, start_station, end_station):
    points = build_profile_points_between(profile, start_station, end_station)
    if len(points) < 2:
        return None
    segments = split_group_by_sign(points)
    segments = absorb_short_internal_opposites(segments)
    return finalize_package_segments(segments, profile)


def merge_overlapping_primary_packages(packages, profile):
    if not packages:
        return []
    ordered = sorted(
        packages,
        key=lambda package: package_station_range(package)[0] if package_station_range(package) is not None else 0.0
    )
    merged = []
    for package in ordered:
        curr_range = package_station_range(package)
        if curr_range is None:
            continue
        if not merged:
            merged.append(package)
            continue
        previous = merged[-1]
        prev_range = package_station_range(previous)
        if prev_range is None:
            merged.append(package)
            continue
        same_primary = package_primary_type(previous) == package_primary_type(package)
        overlaps = curr_range[0] <= prev_range[1] + 1e-6
        if not (same_primary and overlaps):
            merged.append(package)
            continue
        rebuilt = finalize_package_range(
            profile,
            min(prev_range[0], curr_range[0]),
            max(prev_range[1], curr_range[1]),
        )
        if rebuilt is None:
            merged.append(package)
            continue
        merged[-1] = rebuilt
    return merged


def absorb_short_opposite_packages(packages, profile):
    if len(packages) < 3:
        return list(packages)
    ordered = sorted(
        packages,
        key=lambda package: package_station_range(package)[0] if package_station_range(package) is not None else 0.0
    )
    changed = True
    while changed and len(ordered) >= 3:
        changed = False
        index = 1
        while index < len(ordered) - 1:
            previous = ordered[index - 1]
            current = ordered[index]
            following = ordered[index + 1]
            prev_type = package_primary_type(previous)
            curr_type = package_primary_type(current)
            next_type = package_primary_type(following)
            prev_range = package_station_range(previous)
            curr_range = package_station_range(current)
            next_range = package_station_range(following)
            if (
                prev_type is None or curr_type is None or next_type is None or
                prev_range is None or curr_range is None or next_range is None
            ):
                index += 1
                continue
            prev_gap = max(0.0, curr_range[0] - prev_range[1])
            next_gap = max(0.0, next_range[0] - curr_range[1])
            curr_span = max(0.0, curr_range[1] - curr_range[0])
            if (
                prev_type == next_type and
                curr_type != prev_type and
                curr_span <= MAX_OPPOSITE_TYPE_GAP and
                prev_gap <= PACKAGE_JOIN_MAX_DISTANCE and
                next_gap <= PACKAGE_JOIN_MAX_DISTANCE
            ):
                rebuilt = finalize_package_range(profile, prev_range[0], next_range[1])
                if rebuilt is not None:
                    ordered[index - 1:index + 2] = [rebuilt]
                    changed = True
                    break
            index += 1
    return ordered


def packages_by_connected_valeta(profile):
    packages = []
    for group in group_any_valeta(profile):
        for part in split_at_internal_grade_break(group):
            clean_points = [
                item for item in part
                if item.get("x") is not None and item.get("y") is not None and item.get("z") is not None
            ]
            if len(clean_points) < 2:
                continue
            segments = split_group_by_sign(clean_points)
            segments = [
                segment for segment in segments
                if len(segment["points"]) >= 2
            ]
            segments = absorb_short_internal_opposites(segments)
            segments = [
                segment for segment in segments
                if len(segment["points"]) >= 2
            ]
            if not segments:
                continue
            package = finalize_package_segments(segments, profile)
            if package is not None:
                packages.append(package)
    packages = merge_overlapping_primary_packages(packages, profile)
    packages = resolve_group_package_overlaps(packages, "CORTE")
    packages = merge_overlapping_primary_packages(packages, profile)
    packages = absorb_short_opposite_packages(packages, profile)
    packages = merge_overlapping_primary_packages(packages, profile)
    return merge_nearby_packages(packages, profile)


def package_primary_type(package):
    segments = package.get("segments", [])
    if not segments:
        return None
    return segments[0].get("type")


def package_station_range(package):
    stations = []
    for segment in package.get("segments", []):
        for item in segment.get("points", []):
            if item.get("station") is not None:
                stations.append(item["station"])
    if not stations:
        return None
    return min(stations), max(stations)


def merge_station_ranges(ranges):
    clean = [
        (min(start, end), max(start, end))
        for start, end in ranges
        if start is not None and end is not None
    ]
    if not clean:
        return []
    clean.sort(key=lambda item: item[0])
    merged = [clean[0]]
    for start, end in clean[1:]:
        prev_start, prev_end = merged[-1]
        if start <= prev_end + 1e-6:
            merged[-1] = (prev_start, max(prev_end, end))
        else:
            merged.append((start, end))
    return merged


def build_points_between(points, start_station, end_station):
    ordered = [
        item for item in sorted(points, key=lambda point: point["station"])
        if item.get("x") is not None and item.get("y") is not None and item.get("z") is not None
    ]
    if len(ordered) < 2 or end_station - start_station <= 1e-6:
        return []
    start_point = point_at_station(ordered, start_station)
    end_point = point_at_station(ordered, end_station)
    if start_point is None or end_point is None:
        return []
    result = [start_point]
    for item in ordered:
        if start_station < item["station"] < end_station:
            result.append(item)
    if abs(result[-1]["station"] - end_point["station"]) > 1e-6:
        result.append(end_point)
    return result


def trim_points_by_blocked_ranges(points, blocked_ranges):
    ordered = [
        item for item in sorted(points, key=lambda point: point["station"])
        if item.get("x") is not None and item.get("y") is not None and item.get("z") is not None
    ]
    if len(ordered) < 2:
        return []
    start_station = ordered[0]["station"]
    end_station = ordered[-1]["station"]
    if end_station - start_station < MIN_LOCAL_SEGMENT_LENGTH:
        return []
    merged = merge_station_ranges(blocked_ranges)
    if not merged:
        return [ordered]
    chunks = []
    cursor = start_station
    for block_start, block_end in merged:
        if block_end <= cursor:
            continue
        if block_start > cursor:
            chunk = build_points_between(ordered, cursor, min(block_start, end_station))
            if len(chunk) >= 2 and chunk[-1]["station"] - chunk[0]["station"] >= MIN_LOCAL_SEGMENT_LENGTH:
                chunks.append(chunk)
        cursor = max(cursor, block_end)
        if cursor >= end_station:
            break
    if cursor < end_station:
        chunk = build_points_between(ordered, cursor, end_station)
        if len(chunk) >= 2 and chunk[-1]["station"] - chunk[0]["station"] >= MIN_LOCAL_SEGMENT_LENGTH:
            chunks.append(chunk)
    return chunks


def resolve_group_package_overlaps(group_packages, base_type):
    if not group_packages:
        return []
    dominant_ranges = merge_station_ranges([
        package_station_range(package)
        for package in group_packages
        if package_primary_type(package) == base_type and package_station_range(package) is not None
    ])
    if not dominant_ranges:
        return group_packages
    resolved = []
    for package in group_packages:
        package_type = package_primary_type(package)
        if package_type == base_type:
            resolved.append(package)
            continue
        new_segments = []
        for segment in package.get("segments", []):
            for chunk in trim_points_by_blocked_ranges(segment.get("points", []), dominant_ranges):
                if len(chunk) < 2 or chunk[-1]["station"] - chunk[0]["station"] < MIN_LOCAL_SEGMENT_LENGTH:
                    continue
                new_segments.append({
                    "type": segment["type"],
                    "points": chunk,
                })
        for segment in new_segments:
            outlet = downstream_end_by_ends(segment["points"])
            resolved.append({
                "segments": [segment],
                "outlet": outlet,
                "outlet_type": segment["type"],
            })
    resolved.sort(key=lambda package: package_station_range(package)[0] if package_station_range(package) is not None else 0.0)
    return resolved


def dominant_downstream_endpoint(points):
    first = points[0]
    last = points[-1]
    dz = last["z"] - first["z"]
    if abs(dz) > VERTICAL_NOISE_TOL:
        return last if dz < 0.0 else first
    # Se inicio/fim ficam praticamente empatados, usa a menor cota global.
    return min(points, key=lambda item: item["z"])


def downstream_end_by_ends(points):
    clean = [
        item for item in points
        if item.get("x") is not None and item.get("y") is not None and item.get("z") is not None
    ]
    if len(clean) < 2:
        return clean[0] if clean else None
    first = clean[0]
    last = clean[-1]
    dz = last["z"] - first["z"]
    # V45: o sentido do caimento NAO usa mais o VERTICAL_NOISE_TOL (IN[13]). Aquele
    # parametro e de ruido/espigao (metros) e, com 4m, qualquer valeta com menos de 4m
    # de desnivel entre as pontas caia no "return last" e ganhava saida na estaca final
    # mesmo subindo -- era isso que invertia entrada/saida. Agora so e considerado
    # empate quando o desnivel real e menor que FLOW_DIRECTION_TOL.
    if abs(dz) > FLOW_DIRECTION_TOL:
        return last if dz < 0.0 else first
    # Empate real (terreno plano): sai pela ponta mais proxima do ponto mais baixo.
    low = min(clean, key=lambda item: item["z"])
    if abs(low["station"] - first["station"]) < abs(low["station"] - last["station"]):
        return first
    return last


def ordered_flow_points(points, outlet=None):
    clean = [
        item for item in points
        if item.get("x") is not None and item.get("y") is not None and item.get("z") is not None
    ]
    if len(clean) < 2:
        return clean
    if outlet is None:
        outlet = downstream_end_by_ends(clean)
    if outlet is not None:
        dist_first = (clean[0]["x"] - outlet["x"]) ** 2 + (clean[0]["y"] - outlet["y"]) ** 2
        dist_last = (clean[-1]["x"] - outlet["x"]) ** 2 + (clean[-1]["y"] - outlet["y"]) ** 2
        if dist_first < dist_last:
            return list(reversed(clean))
    return list(clean)


def interpolate_path_ratio(a, b, ratio):
    ratio = max(0.0, min(1.0, ratio))
    point = {}
    for key in ["station", "x", "y", "z", "height", "axis_x", "axis_y", "away_x", "away_y"]:
        if a.get(key) is not None and b.get(key) is not None:
            point[key] = a[key] + (b[key] - a[key]) * ratio
        elif a.get(key) is not None:
            point[key] = a[key]
        elif b.get(key) is not None:
            point[key] = b[key]
    point["decision"] = a.get("decision", b.get("decision", "INTERPOLADO"))
    return point


def path_length(points):
    total = 0.0
    for index in range(1, len(points)):
        dx = points[index]["x"] - points[index - 1]["x"]
        dy = points[index]["y"] - points[index - 1]["y"]
        total += (dx * dx + dy * dy) ** 0.5
    return total


def point_at_path_distance(points, target_distance):
    if not points:
        return None
    if target_distance <= 0.0:
        return points[0]
    traveled = 0.0
    for index in range(1, len(points)):
        a = points[index - 1]
        b = points[index]
        dx = b["x"] - a["x"]
        dy = b["y"] - a["y"]
        length = (dx * dx + dy * dy) ** 0.5
        if length < 1e-9:
            continue
        if traveled + length >= target_distance:
            ratio = (target_distance - traveled) / length
            return interpolate_path_ratio(a, b, ratio)
        traveled += length
    return points[-1]


def ensure_layer(db, tr, name, color_index):
    layer_table = tr.GetObject(db.LayerTableId, OpenMode.ForRead)
    if layer_table.Has(name):
        record = tr.GetObject(layer_table[name], OpenMode.ForWrite)
        record.Color = Color.FromColorIndex(ColorMethod.ByAci, color_index)
        record.LineWeight = LineWeight.LineWeight050
        return
    layer_table.UpgradeOpen()
    record = LayerTableRecord()
    record.Name = name
    record.Color = Color.FromColorIndex(ColorMethod.ByAci, color_index)
    record.LineWeight = LineWeight.LineWeight050
    layer_table.Add(record)
    tr.AddNewlyCreatedDBObject(record, True)


def append_polyline(model_space, tr, points_data, layer):
    points_data = [
        item for item in points_data
        if item.get("x") is not None and item.get("y") is not None
    ]
    if len(points_data) < 2:
        return None
    polyline = Polyline()
    for index, item in enumerate(points_data):
        polyline.AddVertexAt(index, Point2d(item["x"], item["y"]), 0.0, 0.0, 0.0)
    polyline.Layer = layer
    polyline.ConstantWidth = VALETA_WIDTH
    polyline.LineWeight = LineWeight.LineWeight050
    model_space.AppendEntity(polyline)
    tr.AddNewlyCreatedDBObject(polyline, True)
    return polyline


def append_closed_polyline(model_space, tr, points, layer, hatch=True):
    polyline = Polyline()
    for index, point in enumerate(points):
        polyline.AddVertexAt(index, Point2d(point[0], point[1]), 0.0, 0.0, 0.0)
    polyline.Closed = True
    polyline.Layer = layer
    polyline.LineWeight = LineWeight.LineWeight050
    model_space.AppendEntity(polyline)
    tr.AddNewlyCreatedDBObject(polyline, True)
    if hatch:
        try:
            hatch_obj = Hatch()
            hatch_obj.Layer = layer
            hatch_obj.SetHatchPattern(HatchPatternType.PreDefined, "SOLID")
            model_space.AppendEntity(hatch_obj)
            tr.AddNewlyCreatedDBObject(hatch_obj, True)
            ids = ObjectIdCollection()
            ids.Add(polyline.ObjectId)
            hatch_obj.AppendLoop(HatchLoopTypes.External, ids)
            hatch_obj.EvaluateHatch(True)
        except Exception:
            pass
    return polyline


def point_to_segment_distance(point, a, b):
    px, py = point["x"], point["y"]
    ax, ay = a["x"], a["y"]
    bx, by = b["x"], b["y"]
    dx = bx - ax
    dy = by - ay
    denominator = dx * dx + dy * dy
    if denominator < 1e-12:
        return ((px - ax) ** 2 + (py - ay) ** 2) ** 0.5
    t = ((px - ax) * dx + (py - ay) * dy) / denominator
    t = max(0.0, min(1.0, t))
    cx = ax + dx * t
    cy = ay + dy * t
    return ((px - cx) ** 2 + (py - cy) ** 2) ** 0.5


def package_all_points(package):
    result = []
    for segment in package.get("segments", []):
        for point in segment.get("points", []):
            if point.get("x") is None or point.get("y") is None:
                continue
            if not result or point["station"] != result[-1]["station"]:
                result.append(point)
    return result


def outlet_falls_on_another_valeta(outlet, side_packages, package_index, tolerance):
    # Um dissipador so faz sentido quando a valeta realmente TERMINA. Se a saida deste
    # pacote cai em cima do tracado de outro pacote do mesmo lado -- o que acontece
    # quando a extensao do corte ate o aterro (extend_cut_until_first_fill) avanca por
    # cima do proximo grupo, deixando os dois pacotes sobrepostos em estaca -- entao a
    # agua continua correndo na valeta seguinte e nao ha nada para dissipar ali. Sem
    # este teste, o dissipador aparecia pendurado no MEIO de uma valeta continua.
    if outlet is None or outlet.get("x") is None or outlet.get("y") is None:
        return False
    outlet_station = float(outlet.get("station", 0.0))
    for other_index, other in enumerate(side_packages):
        if other_index == package_index:
            continue
        other_range = package_station_range(other)
        if other_range is None:
            continue
        # pre-filtro barato por estaca, para nao varrer todos os pontos de todos os pacotes
        if outlet_station < other_range[0] - 25.0 or outlet_station > other_range[1] + 25.0:
            continue
        points = package_all_points(other)
        for index in range(1, len(points)):
            if point_to_segment_distance(outlet, points[index - 1], points[index]) <= tolerance:
                return True
    return False


def create_polylines(db, tr, packages_by_side):
    ensure_layer(db, tr, "VALETA_CORTE_LE", 84)
    ensure_layer(db, tr, "VALETA_CORTE_LD", 84)
    ensure_layer(db, tr, "VALETA_ATERRO_LE", 211)
    ensure_layer(db, tr, "VALETA_ATERRO_LD", 211)
    ensure_layer(db, tr, "DISSIPADOR_CORTE", 84)
    ensure_layer(db, tr, "DISSIPADOR_ATERRO", 211)
    ensure_layer(db, tr, "SETA_CAIMENTO_VALETA", 7)
    block_table = tr.GetObject(db.BlockTableId, OpenMode.ForRead)
    model_space = tr.GetObject(block_table[BlockTableRecord.ModelSpace], OpenMode.ForWrite)
    created = []
    outlets = []
    arrow_segments = []
    plan_records = []
    debug_rows = []
    removed = 0
    tool_layers = [
        "VALETA_CORTE_LE", "VALETA_CORTE_LD",
        "VALETA_ATERRO_LE", "VALETA_ATERRO_LD",
        "DISSIPADOR_CORTE", "DISSIPADOR_ATERRO", "SETA_CAIMENTO_VALETA"
    ]
    for object_id in model_space:
        try:
            obj = tr.GetObject(object_id, OpenMode.ForRead)
            if obj.Layer in tool_layers:
                obj.UpgradeOpen()
                obj.Erase()
                removed += 1
        except Exception:
            pass
    for side in ["LE", "LD"]:
        side_packages = sorted(
            packages_by_side[side],
            key=lambda pkg: (
                package_station_range(pkg)[0]
                if package_station_range(pkg) is not None else 0.0
            )
        )
        touches_next_package = [False] * len(side_packages)
        bridge_next_package = [False] * len(side_packages)
        bridge_target = [None] * len(side_packages)
        bridge_backward = [False] * len(side_packages)
        outlet_on_other = [False] * len(side_packages)
        for idx in range(len(side_packages)):
            # V45: a costura/supressao de dissipador precisa olhar para o lado onde a
            # agua SAI. Antes so se olhava o vao ate o PROXIMO pacote, entao uma valeta
            # que drena para tras (saida na estaca inicial) perdia o dissipador na saida
            # real e era emendada no proximo pacote pela ponta de montante.
            curr_range = package_station_range(side_packages[idx])
            if curr_range is None:
                continue
            outlet = side_packages[idx].get("outlet")
            outlet_at_start = (
                outlet is not None and outlet.get("station") is not None and
                abs(outlet["station"] - curr_range[0]) < abs(outlet["station"] - curr_range[1])
            )
            if outlet_at_start:
                if idx == 0:
                    continue
                prev_range = package_station_range(side_packages[idx - 1])
                if prev_range is None:
                    continue
                gap = curr_range[0] - prev_range[1]
                if gap <= package_touch_tolerance():
                    touches_next_package[idx] = True
                    if gap > -1e-6:
                        bridge_next_package[idx] = True
                        bridge_backward[idx] = True
                        bridge_target[idx] = package_last_point(side_packages[idx - 1])
                continue
            if idx + 1 >= len(side_packages):
                continue
            next_range = package_station_range(side_packages[idx + 1])
            if next_range is None:
                continue
            gap = next_range[0] - curr_range[1]
            # A saida de um pacote encosta no inicio do proximo (sem vazio real entre
            # eles): a vazao acumula direto no proximo trecho, nao precisa dissipador
            # aqui -- dissipador so faz sentido quando o trecho realmente termina sem
            # continuacao.
            if gap <= package_touch_tolerance():
                # Vazio pequeno OU sobreposicao (gap negativo): nos dois casos a valeta
                # continua, entao nao ha dissipador. A diferenca e que so faz sentido
                # esticar ate o inicio do proximo pacote quando existe vazio de verdade;
                # sobrepostos ja se encontram, e esticar desenharia um gancho para tras.
                touches_next_package[idx] = True
                if gap > -1e-6:
                    bridge_next_package[idx] = True
                    bridge_target[idx] = package_first_point(side_packages[idx + 1])
        for package_index, package in enumerate(side_packages):
            outlet_on_other[package_index] = outlet_falls_on_another_valeta(
                side_packages[package_index].get("outlet"),
                side_packages, package_index, max(2.0, VALETA_WIDTH * 4.0)
            )
        for package_index, package in enumerate(side_packages):
            package_arrow_points = []
            if "segments" in package:
                package_outlet = package.get("outlet")
                package_outlet_type = package.get("outlet_type", item_type(package_outlet))
                package_touches_next = (
                    touches_next_package[package_index] or outlet_on_other[package_index]
                )
                next_package_start = (
                    bridge_target[package_index]
                    if bridge_next_package[package_index] else None
                )
                drawable_segments = []
                for segment in package["segments"]:
                    segment_type = segment["type"]
                    segment_points = segment["points"]
                    has_support = segment_has_direct_support(segment_points, segment_type)
                    touches_outlet = (
                        package_outlet is not None and
                        segment_type == package_outlet_type and
                        segment_touches_outlet(segment_points, package_outlet)
                    )
                    if has_support or touches_outlet:
                        drawable_segments.append({
                            "type": segment_type,
                            "points": segment_points,
                            "touches_outlet": touches_outlet,
                        })
                for segment in drawable_segments:
                    segment_type = segment["type"]
                    segment_points = segment["points"]
                    if segment.get("touches_outlet") and package_touches_next:
                        # Sem dissipador aqui. Havendo vazio real, fecha a costura ate o
                        # inicio do proximo pacote; se os pacotes ja se sobrepoem, nao
                        # desenha rabicho nenhum -- era ele que virava a haste solta
                        # apontando para fora no meio da valeta.
                        if next_package_start is not None and bridge_backward[package_index]:
                            draw_points = [next_package_start] + list(segment_points)
                        elif next_package_start is not None:
                            draw_points = list(segment_points) + [next_package_start]
                        else:
                            draw_points = list(segment_points)
                    elif segment.get("touches_outlet"):
                        draw_points = extend_segment_to_outlet(segment_points, package, side, segment_type)
                    else:
                        draw_points = list(segment_points)
                    polyline = append_polyline(model_space, tr, draw_points, "VALETA_" + segment_type + "_" + side)
                    if polyline is None:
                        continue
                    created.append([
                        segment_type, side,
                        fmt(segment_points[0]["station"]),
                        fmt(segment_points[-1]["station"]),
                        fmt(path_length(draw_points)),
                        len(segment_points), polyline.Handle.ToString()
                    ])
                    segment_outlet = downstream_end_by_ends(segment_points)
                    draws_dissipator = (
                        not package_touches_next and
                        package_outlet is not None and
                        package_outlet_type == segment_type and
                        segment_outlet is not None and
                        (
                            xy_distance(segment_outlet, package_outlet) <= max(0.75, VALETA_WIDTH * 2.0) or
                            abs(float(segment_outlet.get("station", 0.0)) - float(package_outlet.get("station", 0.0))) <= 0.05
                        )
                    )
                    plan_records.append({
                        "segment_type": segment_type,
                        "side": side,
                        "station_start": float(segment_points[0]["station"]),
                        "station_end": float(segment_points[-1]["station"]),
                        "start_point": segment_points[0],
                        "end_point": segment_points[-1],
                        "outlet_point": segment_outlet,
                        "length_drawn": path_length(draw_points),
                        "section_critica_m": path_length(segment_points),
                        "slope_pct": longitudinal_slope_pct(segment_points),
                        "handle": polyline.Handle.ToString(),
                        "layer": "VALETA_" + segment_type + "_" + side,
                        "segment_points": list(segment_points),
                        "desenha_dissipador": draws_dissipator,
                    })
                    for point in segment_points:
                        if not package_arrow_points or point["station"] != package_arrow_points[-1]["station"]:
                            package_arrow_points.append(point)
            else:
                cut = package["cut"]
                cut_polyline = append_polyline(model_space, tr, cut, "VALETA_CORTE_" + side)
                if cut_polyline is not None:
                    created.append([
                        "CORTE", side, fmt(cut[0]["station"]), fmt(cut[-1]["station"]),
                        fmt(path_length(cut)),
                        len(cut), cut_polyline.Handle.ToString()
                    ])
                    cut_outlet = downstream_end_by_ends(cut)
                    cut_package_outlet = package.get("outlet")
                    cut_outlet_type = package.get("outlet_type", item_type(cut_package_outlet))
                    plan_records.append({
                        "segment_type": "CORTE",
                        "side": side,
                        "station_start": float(cut[0]["station"]),
                        "station_end": float(cut[-1]["station"]),
                        "start_point": cut[0],
                        "end_point": cut[-1],
                        "outlet_point": cut_outlet,
                        "length_drawn": path_length(cut),
                        "section_critica_m": path_length(cut),
                        "slope_pct": longitudinal_slope_pct(cut),
                        "handle": cut_polyline.Handle.ToString(),
                        "layer": "VALETA_CORTE_" + side,
                        "segment_points": list(cut),
                        "desenha_dissipador": (
                            cut_package_outlet is not None and
                            cut_outlet_type == "CORTE" and
                            cut_outlet is not None and
                            (
                                xy_distance(cut_outlet, cut_package_outlet) <= max(0.75, VALETA_WIDTH * 2.0) or
                                abs(float(cut_outlet.get("station", 0.0)) - float(cut_package_outlet.get("station", 0.0))) <= 0.05
                            )
                        ),
                    })
                    package_arrow_points.extend(cut)

                extension = package["fill_extension"]
                fill_polyline = append_polyline(model_space, tr, extension, "VALETA_ATERRO_" + side)
                if fill_polyline is not None:
                    created.append([
                        "ATERRO", side, fmt(extension[0]["station"]), fmt(extension[-1]["station"]),
                        fmt(path_length(extension)),
                        len(extension), fill_polyline.Handle.ToString()
                    ])
                    fill_outlet = downstream_end_by_ends(extension)
                    fill_package_outlet = package.get("outlet")
                    fill_outlet_type = package.get("outlet_type", item_type(fill_package_outlet))
                    plan_records.append({
                        "segment_type": "ATERRO",
                        "side": side,
                        "station_start": float(extension[0]["station"]),
                        "station_end": float(extension[-1]["station"]),
                        "start_point": extension[0],
                        "end_point": extension[-1],
                        "outlet_point": fill_outlet,
                        "length_drawn": path_length(extension),
                        "section_critica_m": path_length(extension),
                        "slope_pct": longitudinal_slope_pct(extension),
                        "handle": fill_polyline.Handle.ToString(),
                        "layer": "VALETA_ATERRO_" + side,
                        "segment_points": list(extension),
                        "desenha_dissipador": (
                            fill_package_outlet is not None and
                            fill_outlet_type == "ATERRO" and
                            fill_outlet is not None and
                            (
                                xy_distance(fill_outlet, fill_package_outlet) <= max(0.75, VALETA_WIDTH * 2.0) or
                                abs(float(fill_outlet.get("station", 0.0)) - float(fill_package_outlet.get("station", 0.0))) <= 0.05
                            )
                        ),
                    })
                    package_arrow_points.extend(extension)

            curr_range = package_station_range(package)
            next_range = (
                package_station_range(side_packages[package_index + 1])
                if package_index + 1 < len(side_packages) else None
            )
            debug_rows.append([
                side, package_index + 1,
                fmt(curr_range[0]) if curr_range else "", fmt(curr_range[1]) if curr_range else "",
                package_primary_type(package) or "",
                fmt(package.get("outlet", {}).get("station")) if package.get("outlet") else "",
                fmt(next_range[0] - curr_range[1]) if (curr_range and next_range) else "",
                "SIM" if touches_next_package[package_index] else "-",
                "SIM" if outlet_on_other[package_index] else "-",
                "-" if package_touches_next else "SIM",
            ])
            outlet = package["outlet"]
            if outlet is not None and not package_touches_next:
                outlet_type = package.get("outlet_type", item_type(outlet))
                if outlet_type is None:
                    outlet_type = "ATERRO"
                key = side + "|" + fmt(outlet["station"]) + "|" + outlet_type
                if key not in outlets:
                    create_dissipator(model_space, tr, package, side, outlet_type)
                    outlets.append(key)
            if package_arrow_points:
                arrow_segments.append([package_arrow_points, package.get("outlet")])
    for arrow_data in arrow_segments:
        create_flow_arrows(model_space, tr, arrow_data[0], "SETA_CAIMENTO_VALETA", arrow_data[1])
    plan_rows = build_plan_rows(plan_records)
    # V47: a nota nunca pode derrubar o desenho. Se der erro, registra e segue.
    try:
        nota_rows = build_nota_servico_rows(plan_records)
    except Exception as nota_error:
        nota_rows = []
        NOTA_ERRORS.append("Erro ao montar nota de servico: " + str(nota_error))
    return created, outlets, removed, plan_rows, debug_rows, nota_rows


def create_flow_arrows(model_space, tr, points_data, layer, outlet=None):
    points_data = ordered_flow_points(points_data, outlet)
    if len(points_data) < 2:
        return
    total_length = path_length(points_data)
    if total_length < 1e-6:
        return
    center_distance = min(FLOW_ARROW_SPACING / 2.0, total_length / 2.0)
    while center_distance < total_length + 1e-6:
        half_arrow = min(FLOW_ARROW_LENGTH / 2.0, total_length / 2.0)
        a = point_at_path_distance(points_data, max(0.0, center_distance - half_arrow))
        b = point_at_path_distance(points_data, min(total_length, center_distance + half_arrow))
        if a is None or b is None:
            center_distance += FLOW_ARROW_SPACING
            continue
        dx = b["x"] - a["x"]
        dy = b["y"] - a["y"]
        length = (dx * dx + dy * dy) ** 0.5
        if length < 1e-6:
            center_distance += FLOW_ARROW_SPACING
            continue
        ux = dx / length
        uy = dy / length
        px = -uy
        py = ux
        center_x = (a["x"] + b["x"]) / 2.0
        center_y = (a["y"] + b["y"]) / 2.0
        center_z = (a["z"] + b["z"]) / 2.0
        arrow_len = min(FLOW_ARROW_LENGTH, max(1.2, length * 0.8))
        half = arrow_len / 2.0
        body_w = 0.42
        head_w = 1.00
        tail_x = center_x - ux * half
        tail_y = center_y - uy * half
        front_x = tail_x + ux * (arrow_len * 0.62)
        front_y = tail_y + uy * (arrow_len * 0.62)
        tip_x = center_x + ux * half
        tip_y = center_y + uy * half
        pts = [
            (tail_x + px * body_w / 2.0, tail_y + py * body_w / 2.0),
            (front_x + px * body_w / 2.0, front_y + py * body_w / 2.0),
            (front_x + px * head_w / 2.0, front_y + py * head_w / 2.0),
            (tip_x, tip_y),
            (front_x - px * head_w / 2.0, front_y - py * head_w / 2.0),
            (front_x - px * body_w / 2.0, front_y - py * body_w / 2.0),
            (tail_x - px * body_w / 2.0, tail_y - py * body_w / 2.0),
        ]
        append_closed_polyline(model_space, tr, pts, layer, True)
        center_distance += FLOW_ARROW_SPACING


def unit_xy(dx, dy):
    length = (dx * dx + dy * dy) ** 0.5
    if length < 1e-9:
        return 1.0, 0.0
    return dx / length, dy / length


def same_xy(a, b):
    if a is None or b is None:
        return False
    if a.get("x") is None or a.get("y") is None or b.get("x") is None or b.get("y") is None:
        return False
    return ((a["x"] - b["x"]) ** 2 + (a["y"] - b["y"]) ** 2) <= 1e-6


def xy_distance(a, b):
    if a is None or b is None:
        return 1e12
    if a.get("x") is None or a.get("y") is None or b.get("x") is None or b.get("y") is None:
        return 1e12
    dx = a["x"] - b["x"]
    dy = a["y"] - b["y"]
    return (dx * dx + dy * dy) ** 0.5


def outlet_extension_geometry(package, side):
    outlet = package["outlet"]
    if outlet is None or outlet.get("x") is None or outlet.get("y") is None or outlet.get("z") is None:
        return None
    segments = package.get("segments", [])
    all_points = []
    for segment in segments:
        for point in segment["points"]:
            if point.get("x") is None or point.get("y") is None or point.get("z") is None:
                continue
            if not all_points or point["station"] != all_points[-1]["station"]:
                all_points.append(point)
    all_points = ordered_flow_points(all_points, outlet)
    if len(all_points) < 2:
        return None
    if (all_points[-1]["x"] - outlet["x"]) ** 2 + (all_points[-1]["y"] - outlet["y"]) ** 2 <= 1e-6:
        adjacent = all_points[-2]
    else:
        adjacent = all_points[1]
    flow_x, flow_y = unit_xy(outlet["x"] - adjacent["x"], outlet["y"] - adjacent["y"])
    away_x = outlet.get("away_x")
    away_y = outlet.get("away_y")
    if away_x is None or away_y is None:
        axis_x = outlet.get("axis_x")
        axis_y = outlet.get("axis_y")
        if axis_x is not None and axis_y is not None:
            away_x, away_y = unit_xy(outlet["x"] - axis_x, outlet["y"] - axis_y)
        elif side == "LE":
            away_x, away_y = -flow_y, flow_x
        else:
            away_x, away_y = flow_y, -flow_x
    out_x, out_y = unit_xy(flow_x + away_x, flow_y + away_y)
    x = outlet["x"]
    y = outlet["y"]
    z = outlet["z"]
    return {
        "end": {
            "station": outlet.get("station"),
            "x": x + out_x * OUTLET_LENGTH,
            "y": y + out_y * OUTLET_LENGTH,
            "z": z,
            "height": outlet.get("height"),
            "decision": outlet.get("decision", "SAIDA_VALETA"),
        },
        "out_x": out_x,
        "out_y": out_y,
    }


def extend_segment_to_outlet(segment_points, package, side, segment_type):
    outlet = package.get("outlet")
    geometry = outlet_extension_geometry(package, side)
    if outlet is None or geometry is None or len(segment_points) < 2:
        return list(segment_points)
    outlet_type = package.get("outlet_type", item_type(outlet))
    if outlet_type != segment_type:
        return list(segment_points)
    ordered_points = [
        item for item in segment_points
        if item.get("x") is not None and item.get("y") is not None and item.get("z") is not None
    ]
    if len(ordered_points) < 2:
        return list(segment_points)
    start_dist = xy_distance(ordered_points[0], outlet)
    end_dist = xy_distance(ordered_points[-1], outlet)
    flow_points = list(ordered_points if end_dist <= start_dist else reversed(ordered_points))
    if xy_distance(flow_points[-1], outlet) > max(0.75, VALETA_WIDTH * 2.0):
        return list(segment_points)
    end = geometry["end"]
    if not same_xy(flow_points[-1], outlet):
        flow_points.append(outlet)
    if same_xy(flow_points[-1], end):
        return flow_points
    return flow_points + [end]


def side_to_bordo(side):
    return "BE" if side == "LE" else "BD"


def plan_segment_order_key(record):
    # V48: todas as VPAC e depois todas as VPCC; dentro de cada tipo, todo o LE (BE)
    # e depois todo o LD (BD), em ordem de estaca.
    return (
        0 if record.get("segment_type") == "ATERRO" else 1,
        0 if record.get("side") == "LE" else 1,
        float(record.get("station_start", 0.0)),
    )


def longitudinal_slope_pct(points):
    clean = [
        item for item in points
        if item.get("x") is not None and item.get("y") is not None and item.get("z") is not None
    ]
    if len(clean) < 2:
        return 0.0
    length = path_length(clean)
    if length < 1e-9:
        return 0.0
    return ((clean[-1]["z"] - clean[0]["z"]) / length) * 100.0


def endpoint_match_score(point, record):
    if point is None:
        return 1e12
    scores = []
    for endpoint in [record.get("start_point"), record.get("end_point")]:
        if endpoint is None:
            continue
        scores.append(min(
            xy_distance(point, endpoint),
            abs(float(point.get("station", 0.0)) - float(endpoint.get("station", 0.0)))
        ))
    return min(scores) if scores else 1e12


def ordered_plan_records(records):
    aterro = sorted(
        [record for record in records if record.get("segment_type") == "ATERRO"],
        key=plan_segment_order_key,
    )
    corte = sorted(
        [record for record in records if record.get("segment_type") == "CORTE"],
        key=plan_segment_order_key,
    )
    return aterro + corte


def assign_plan_numbers(records):
    ordered = ordered_plan_records(records)
    for index, record in enumerate(ordered):
        record["number"] = index + 1
    return ordered


def resolve_plan_connections(records, tolerance=None):
    if tolerance is None:
        tolerance = max(0.75, VALETA_WIDTH * 2.0)
    for record in records:
        outlet_point = record.get("outlet_point")
        best = None
        best_score = 1e12
        for other in records:
            if other is record or other.get("side") != record.get("side"):
                continue
            score = endpoint_match_score(outlet_point, other)
            if score <= tolerance and score < best_score:
                best = other
                best_score = score
        if best is not None:
            record["link_to"] = best
            record["ligacao_tipo"] = "Ligar em VPAC" if best.get("segment_type") == "ATERRO" else "Ligar em VPCC"
            record["ligacao_numero"] = best.get("number")
            record["tem_dissipador"] = False
        else:
            record["link_to"] = None
            record["ligacao_tipo"] = "Ligar em dissipador" if record.get("desenha_dissipador") else "-"
            record["ligacao_numero"] = None
            record["tem_dissipador"] = bool(record.get("desenha_dissipador"))


def build_plan_rows(records, tolerance=None):
    ordered = assign_plan_numbers(records)
    resolve_plan_connections(ordered, tolerance)
    output = []
    for record in ordered:
        outlet_station = record["outlet_point"]["station"] if record.get("outlet_point") is not None else None
        output.append([
            record.get("number"),
            "VPAC" if record.get("segment_type") == "ATERRO" else "VPCC",
            record.get("side"),
            side_to_bordo(record.get("side")),
            fmt(record.get("station_start")),
            fmt(record.get("station_end")),
            fmt(outlet_station),
            fmt(record.get("slope_pct"), 6),
            fmt(record.get("length_drawn")),
            fmt(record.get("section_critica_m")),
            record.get("ligacao_tipo", "-"),
            record.get("ligacao_numero") if record.get("ligacao_numero") is not None else "-",
            "SIM" if record.get("tem_dissipador") else "-",
            record.get("handle", ""),
        ])
    return output


ESTACA_LENGTH = 20.0
NOTA_ERRORS = []

NOTA_SERVICO_HEADERS = [
    "Handle", "Layer", "Estaca_Ini_N", "Estaca_Ini_Simb", "Estaca_Ini_m",
    "Estaca_Fim_N", "Estaca_Fim_Simb", "Estaca_Fim_m", "Bordo",
    "Extensao_m", "Cota_Inicial", "Cota_Final", "Declividade_%",
    "Dispositivo", "Numero", "Sentido_Escoamento", "Estaca_Saida",
    "Liga_Em", "Dissipador",
    "SC_Estaca", "SC_Comp_Proprio_m", "SC_Comp_Montante_m", "SC_Comp_Total_m",
    "SC_Largura_Contrib_Media_m", "SC_Largura_Contrib_Max_m",
    "SC_Area_Propria_m2", "SC_Area_Total_m2", "SC_Dispositivos_Montante",
]


def split_estaca(station):
    # Estaca de 20m: 315,05 -> 15 + 15,050. Arredonda antes para nao gerar "+20,000".
    value = round(float(station), 3)
    number = int(value // ESTACA_LENGTH)
    rest = round(value - number * ESTACA_LENGTH, 3)
    if rest >= ESTACA_LENGTH - 1e-6:
        number += 1
        rest = 0.0
    return number, "+", rest


def estaca_label(station):
    if station is None:
        return ""
    number, simb, rest = split_estaca(station)
    return str(number) + " " + simb + " " + fmt(rest)


def record_contrib_widths(record):
    widths = [
        float(point["contrib_width"])
        for point in record.get("segment_points", [])
        if point.get("contrib_width") is not None
    ]
    if not widths:
        return 0.0, 0.0
    return sum(widths) / len(widths), max(widths)


def accumulate_critical_section(record, upstream_map, stack=None):
    # Secao critica = saida do dispositivo. Acumula o comprimento/area dele mais tudo
    # que desagua nele (dispositivos com link_to apontando para ele), recursivamente.
    if "sc_total" in record:
        return record["sc_total"]
    if stack is None:
        stack = set()
    key = id(record)
    own_length = float(record.get("section_critica_m") or 0.0)
    width_avg, width_max = record_contrib_widths(record)
    own_area = own_length * width_avg
    if key in stack:
        return (own_length, own_area, 0)
    stack.add(key)
    up_length = 0.0
    up_area = 0.0
    up_count = 0
    for other in upstream_map.get(key, []):
        o_length, o_area, o_count = accumulate_critical_section(other, upstream_map, stack)
        up_length += o_length
        up_area += o_area
        up_count += 1 + o_count
    stack.discard(key)
    record["sc_own_length"] = own_length
    record["sc_up_length"] = up_length
    record["sc_width_avg"] = width_avg
    record["sc_width_max"] = width_max
    record["sc_own_area"] = own_area
    record["sc_total"] = (own_length + up_length, own_area + up_area, up_count)
    return record["sc_total"]


def build_nota_servico_rows(records):
    upstream_map = {}
    for record in records:
        target = record.get("link_to")
        if target is not None:
            upstream_map.setdefault(id(target), []).append(record)
    output = []
    for record in sorted(records, key=plan_segment_order_key):
        points = [
            item for item in record.get("segment_points", [])
            if item.get("z") is not None
        ]
        if len(points) < 2:
            continue
        start = points[0]
        end = points[-1]
        ini_n, ini_s, ini_m = split_estaca(start["station"])
        fim_n, fim_s, fim_m = split_estaca(end["station"])
        extension = float(record.get("length_drawn") or 0.0)
        slope = ((end["z"] - start["z"]) / extension * 100.0) if extension > 1e-9 else 0.0
        outlet = record.get("outlet_point")
        if outlet is not None and outlet.get("station") is not None:
            to_start = abs(outlet["station"] - start["station"])
            to_end = abs(outlet["station"] - end["station"])
            sentido = "CRESCENTE" if to_end <= to_start else "DECRESCENTE"
        else:
            sentido = "-"
        total_length, total_area, up_count = accumulate_critical_section(record, upstream_map)
        liga = record.get("ligacao_tipo", "-")
        if record.get("ligacao_numero") is not None:
            liga = liga + " " + str(record.get("ligacao_numero"))
        output.append([
            record.get("handle", ""),
            record.get("layer", ""),
            ini_n, ini_s, fmt(ini_m),
            fim_n, fim_s, fmt(fim_m),
            side_to_bordo(record.get("side")),
            fmt(extension),
            fmt(start["z"]), fmt(end["z"]),
            fmt(slope),
            "VPAC" if record.get("segment_type") == "ATERRO" else "VPCC",
            record.get("number", ""),
            sentido,
            estaca_label(outlet.get("station") if outlet is not None else None),
            liga,
            "SIM" if record.get("tem_dissipador") else "-",
            estaca_label(outlet.get("station") if outlet is not None else None),
            fmt(record.get("sc_own_length")),
            fmt(record.get("sc_up_length")),
            fmt(total_length),
            fmt(record.get("sc_width_avg"), 2),
            fmt(record.get("sc_width_max"), 2),
            fmt(record.get("sc_own_area"), 2),
            fmt(total_area, 2),
            up_count,
        ])
    return output


EXISTING_LINK_TOLERANCE = 2.0
EXISTING_DISSIPATOR_RADIUS = OUTLET_LENGTH + DISS_LENGTH + 2.0


def is_valeta_layer(layer):
    name = str(layer).upper()
    if name.startswith("DISSIPADOR") or name.startswith("SETA_"):
        return False
    return name.startswith("VALETA_") or "VPAC" in name or "VPCC" in name


def layer_valeta_type(layer):
    name = str(layer).upper()
    if "VPAC" in name or "ATERRO" in name:
        return "ATERRO"
    if "VPCC" in name or "CORTE" in name:
        return "CORTE"
    return None


def layer_side(layer):
    name = str(layer).upper()
    if name.endswith("_LE") or name.endswith(" LE") or name.endswith("_BE"):
        return "LE"
    if name.endswith("_LD") or name.endswith(" LD") or name.endswith("_BD"):
        return "LD"
    return None


def alignment_station_offset(alignment, x, y):
    station = clr.Reference[float]()
    offset = clr.Reference[float]()
    alignment.StationOffset(float(x), float(y), station, offset)
    return float(station.Value), float(offset.Value)


def nearest_profile_item(profile, station, key=None):
    best = None
    best_distance = 1e12
    for item in profile:
        if key is not None and item.get(key) is None:
            continue
        distance = abs(item["station"] - station)
        if distance < best_distance:
            best_distance = distance
            best = item
    if best is None or best_distance > max(MAX_STATION_GAP, ESTACA_LENGTH):
        return None
    return best


def strip_outlet_tail(points):
    # O rabicho de saida (7m para fora) muda muito o offset e quase nao muda a estaca.
    # Ele entra na extensao desenhada, mas nao na estaca/cota/secao critica da valeta.
    core = list(points)
    for _ in range(2):
        if len(core) < 3:
            break
        for index in [0, len(core) - 1]:
            neighbor = core[1] if index == 0 else core[-2]
            d_off = abs(core[index]["offset"] - neighbor["offset"])
            d_st = abs(core[index]["station"] - neighbor["station"])
            if d_off > 2.5 and d_off > d_st:
                core.pop(index)
                break
    return core


def nota_from_existing(db, tr, alignment, surface, side_profiles):
    block_table = tr.GetObject(db.BlockTableId, OpenMode.ForRead)
    model_space = tr.GetObject(block_table[BlockTableRecord.ModelSpace], OpenMode.ForRead)
    dissipators = []
    polylines = []
    for object_id in model_space:
        try:
            obj = tr.GetObject(object_id, OpenMode.ForRead)
            layer = str(obj.Layer)
        except Exception:
            continue
        if layer.upper().startswith("DISSIPADOR"):
            try:
                ext = obj.GeometricExtents
                dissipators.append({
                    "x": (ext.MinPoint.X + ext.MaxPoint.X) / 2.0,
                    "y": (ext.MinPoint.Y + ext.MaxPoint.Y) / 2.0,
                })
            except Exception:
                pass
            continue
        if isinstance(obj, Polyline) and is_valeta_layer(layer):
            polylines.append(obj)

    records = []
    for poly in polylines:
        layer = str(poly.Layer)
        raw = []
        for index in range(poly.NumberOfVertices):
            p2 = poly.GetPoint2dAt(index)
            try:
                station, offset = alignment_station_offset(alignment, p2.X, p2.Y)
            except Exception:
                continue
            try:
                z = elevation(surface, p2.X, p2.Y)
            except Exception:
                z = None
            raw.append({"station": station, "offset": offset, "x": p2.X, "y": p2.Y, "z": z})
        if len(raw) < 2:
            NOTA_ERRORS.append("Polilinha " + poly.Handle.ToString() + " (" + layer + ") fora do alinhamento, ignorada.")
            continue
        raw_ends = [raw[0], raw[-1]]
        core = [item for item in strip_outlet_tail(raw) if item.get("z") is not None]
        if len(core) < 2:
            NOTA_ERRORS.append("Polilinha " + poly.Handle.ToString() + " sem cota na superficie, ignorada.")
            continue
        core.sort(key=lambda item: item["station"])

        side = layer_side(layer)
        if side is None:
            offsets = sorted(item["offset"] for item in core)
            side = "LE" if offsets[len(offsets) // 2] < 0.0 else "LD"
        segment_type = layer_valeta_type(layer)
        if segment_type is None:
            mid = core[len(core) // 2]["station"]
            near = nearest_profile_item(side_profiles[side], mid)
            segment_type = item_type(near) if near is not None else None
            if segment_type is None:
                segment_type = "ATERRO"
        for item in core:
            near = nearest_profile_item(side_profiles[side], item["station"], "contrib_width")
            if near is not None:
                item["contrib_width"] = near["contrib_width"]
            item["height"] = 0.0

        # Saida: a ponta que tem dissipador perto; senao a ponta mais baixa.
        has_dissipator = False
        outlet = None
        for end in raw_ends:
            for diss in dissipators:
                if xy_distance(end, diss) <= EXISTING_DISSIPATOR_RADIUS:
                    has_dissipator = True
                    outlet = core[0] if xy_distance(end, core[0]) <= xy_distance(end, core[-1]) else core[-1]
                    break
            if outlet is not None:
                break
        if outlet is None:
            outlet = downstream_end_by_ends(core)

        records.append({
            "segment_type": segment_type,
            "side": side,
            "station_start": float(core[0]["station"]),
            "station_end": float(core[-1]["station"]),
            "start_point": core[0],
            "end_point": core[-1],
            "outlet_point": outlet,
            "length_drawn": float(poly.Length),
            "section_critica_m": path_length(core),
            "slope_pct": longitudinal_slope_pct(core),
            "handle": poly.Handle.ToString(),
            "layer": layer,
            "segment_points": core,
            "desenha_dissipador": has_dissipator,
        })
    plan_rows = build_plan_rows(records, EXISTING_LINK_TOLERANCE)
    return plan_rows, build_nota_servico_rows(records), len(polylines)


def create_dissipator(model_space, tr, package, side, outlet_type):
    outlet = package["outlet"]
    geometry = outlet_extension_geometry(package, side)
    if outlet is None or geometry is None:
        return
    end = geometry["end"]
    out_x = geometry["out_x"]
    out_y = geometry["out_y"]
    layer = "DISSIPADOR_" + outlet_type
    perp_x = -out_y
    perp_y = out_x
    cx = end["x"] + out_x * (DISS_LENGTH / 2.0)
    cy = end["y"] + out_y * (DISS_LENGTH / 2.0)
    pts = [
        (cx - out_x * DISS_LENGTH / 2.0 + perp_x * DISS_WIDTH / 2.0,
         cy - out_y * DISS_LENGTH / 2.0 + perp_y * DISS_WIDTH / 2.0),
        (cx - out_x * DISS_LENGTH / 2.0 - perp_x * DISS_WIDTH / 2.0,
         cy - out_y * DISS_LENGTH / 2.0 - perp_y * DISS_WIDTH / 2.0),
        (cx + out_x * DISS_LENGTH / 2.0 - perp_x * DISS_WIDTH / 2.0,
         cy + out_y * DISS_LENGTH / 2.0 - perp_y * DISS_WIDTH / 2.0),
        (cx + out_x * DISS_LENGTH / 2.0 + perp_x * DISS_WIDTH / 2.0,
         cy + out_y * DISS_LENGTH / 2.0 + perp_y * DISS_WIDTH / 2.0),
    ]
    append_closed_polyline(model_space, tr, pts, layer, True)


doc = Application.DocumentManager.MdiActiveDocument
db = doc.Database
civil_doc = CivilApplication.ActiveDocument
errors = []
skipped_points = []
rows = []
side_profiles = {"LE": [], "LD": []}
created_lines = []
created_outlets = []
created_plan_rows = []
removed_lines = 0
debug_package_rows = []
nota_servico_rows = []
alignment = None
surface = None

headers = [
    "estaca_m", "lado", "offset_encontro_m", "altura_corte_m",
    "z_encontro", "z_d1", "z_d2", "z_d3", "z_d4", "z_d5",
    "inclinacao_d1_pct", "inclinacao_d2_pct", "inclinacao_d3_pct",
    "inclinacao_d4_pct", "inclinacao_d5_pct",
    "waterdrop_d1", "waterdrop_d2", "waterdrop_d3", "waterdrop_d4", "waterdrop_d5",
    "waterdrop_curto_hits", "waterdrop_total_hits",
    "agua_para_pista", "decisao"
]
try:
    if not os.path.isfile(CSV_INPUT):
        raise Exception("CSV nao encontrado: " + CSV_INPUT)

    tr = db.TransactionManager.StartTransaction()
    try:
        available_alignments = []
        for object_id in civil_doc.GetAlignmentIds():
            obj = tr.GetObject(object_id, OpenMode.ForRead)
            available_alignments.append(str(obj.Name))
            if str(obj.Name).strip().upper() == ALIGNMENT_NAME.upper():
                alignment = obj
                break
        available_surfaces = []
        for object_id in civil_doc.GetSurfaceIds():
            obj = tr.GetObject(object_id, OpenMode.ForRead)
            available_surfaces.append(str(obj.Name))
            if str(obj.Name).strip().upper() == SURFACE_NAME.upper():
                surface = obj
                break

        if alignment is None:
            raise Exception(
                "Alinhamento nao encontrado: '" + ALIGNMENT_NAME +
                "' | Disponiveis no desenho: " + " | ".join(available_alignments)
            )
        if surface is None:
            raise Exception(
                "Superficie nao encontrada: '" + SURFACE_NAME +
                "' | Disponiveis no desenho: " + " | ".join(available_surfaces)
            )

        for source in read_latest_rows(CSV_INPUT):
            station = parse_number(source.get("estaca_m"))
            for side, height_key, offset_key in [
                ("LE", "le", "offset_le"),
                ("LD", "ld", "offset_ld"),
            ]:
                cut_height = parse_number(source.get(height_key))
                skirt_offset = parse_number(source.get(offset_key))
                profile_item = {
                    "station": station, "x": None, "y": None, "z": None,
                    "height": cut_height, "decision": "NAO",
                    "side": side, "skirt_offset": skirt_offset,
                }
                side_profiles[side].append(profile_item)
                if abs(skirt_offset) > 0.0:
                    try:
                        outward_sign = offset_outward_sign(skirt_offset)
                        profile_offset = skirt_offset + outward_sign * DITCH_EXTRA_OFFSET
                        profile_point = point_with_axis_reference(alignment, surface, station, profile_offset)
                        profile_item["x"] = profile_point["x"]
                        profile_item["y"] = profile_point["y"]
                        profile_item["z"] = profile_point["z"]
                        profile_item["axis_x"] = profile_point["axis_x"]
                        profile_item["axis_y"] = profile_point["axis_y"]
                        profile_item["away_x"] = profile_point["away_x"]
                        profile_item["away_y"] = profile_point["away_y"]
                    except Exception:
                        pass

                # Aterro positivo e corte negativo. Ambos sao analisados.
                if abs(cut_height) < MIN_CUT_HEIGHT or abs(skirt_offset) <= 0.0:
                    continue
                talude_type = "ATERRO" if cut_height > 0.0 else "CORTE"
                outward_sign = offset_outward_sign(skirt_offset)

                try:
                    skirt_point = point_with_axis_reference(alignment, surface, station, skirt_offset)
                    x0 = skirt_point["x"]
                    y0 = skirt_point["y"]
                    z0 = skirt_point["z"]
                except Exception as point_error:
                    skipped_points.append([
                        fmt(station), side, fmt(skirt_offset), str(point_error)
                    ])
                    continue
                elevations = []
                slopes = []

                for distance in SAMPLE_DISTANCES:
                    try:
                        sample_point = point_with_axis_reference(
                            alignment, surface, station,
                            skirt_offset + outward_sign * distance
                        )
                        z = sample_point["z"]
                        elevations.append(z)
                        slopes.append(((z - z0) / distance) * 100.0)
                    except Exception:
                        elevations.append(None)
                        slopes.append(None)

                valid_slopes = [value for value in slopes if value is not None]
                # Declividade positiva = ponto mais afastado da pista esta mais alto que o
                # encontro do talude, ou seja, o terreno desce em direcao a pista. Exige pelo
                # menos 2 amostras validas e usa a media entre elas, para nao aprovar so por
                # causa de uma amostra isolada com ruido de superficie.
                slope_to_road = (
                    len(valid_slopes) >= 2 and
                    (sum(valid_slopes) / len(valid_slopes)) >= MIN_SLOPE_TO_ROAD_PCT
                )

                water_to_road, waterdrop_results, short_hits, short_valid, total_hits, total_valid = waterdrop_to_road(
                    alignment, surface, station, skirt_offset, skirt_point
                )
                # V46: largura de contribuicao lateral = maior distancia de analise (medida
                # a partir da saia) cuja gota chegou na saia, descontado o afastamento da
                # valeta. E limitada pela maior distancia de analise (IN[3..7]).
                contrib_hits = [
                    result["distance"] for result in waterdrop_results
                    if result.get("positive")
                ]
                if contrib_hits:
                    profile_item["contrib_width"] = max(0.0, max(contrib_hits) - DITCH_EXTRA_OFFSET)
                elif water_to_road is None and slope_to_road:
                    profile_item["contrib_width"] = max(0.0, max(SAMPLE_DISTANCES) - DITCH_EXTRA_OFFSET)
                # O water drop e o criterio principal (segue a agua de verdade pela superficie).
                # A declividade so decide quando o water drop nao teve dado valido suficiente
                # (menos de 3 das 5 distancias), servindo de resgate para nao perder trecho por
                # buraco de superficie -- sem inflar o resultado em pontos onde o water drop ja
                # respondeu "nao vai para a pista".
                if water_to_road:
                    decision = "CRIAR_VALETA_" + talude_type
                elif water_to_road is None:
                    decision = "CRIAR_VALETA_" + talude_type if slope_to_road else "REVISAR_LIMITE_SUPERFICIE"
                else:
                    decision = "DISPENSAR_VALETA"

                if decision in ["CRIAR_VALETA_CORTE", "CRIAR_VALETA_ATERRO"]:
                    draw_offset = skirt_offset + outward_sign * DITCH_EXTRA_OFFSET
                    try:
                        draw_point = point_with_axis_reference(alignment, surface, station, draw_offset)
                        x_draw = draw_point["x"]
                        y_draw = draw_point["y"]
                        z_draw = draw_point["z"]
                        profile_item["x"] = x_draw
                        profile_item["y"] = y_draw
                        profile_item["z"] = z_draw
                        profile_item["axis_x"] = draw_point["axis_x"]
                        profile_item["axis_y"] = draw_point["axis_y"]
                        profile_item["away_x"] = draw_point["away_x"]
                        profile_item["away_y"] = draw_point["away_y"]
                        profile_item["decision"] = decision
                    except Exception as draw_error:
                        skipped_points.append([
                            fmt(station), side, fmt(draw_offset), str(draw_error)
                        ])

                rows.append([
                    fmt(station), side, fmt(skirt_offset), fmt(cut_height), fmt(z0),
                    fmt(elevations[0]), fmt(elevations[1]), fmt(elevations[2]),
                    fmt(elevations[3]), fmt(elevations[4]),
                    fmt(slopes[0]), fmt(slopes[1]), fmt(slopes[2]),
                    fmt(slopes[3]), fmt(slopes[4]),
                    waterdrop_results[0]["label"], waterdrop_results[1]["label"],
                    waterdrop_results[2]["label"], waterdrop_results[3]["label"],
                    waterdrop_results[4]["label"],
                    str(short_hits) + "/" + str(short_valid),
                    str(total_hits) + "/" + str(total_valid),
                    (
                        "SIM" if water_to_road
                        else (
                            ("SIM_DECLIVIDADE" if slope_to_road else "REVISAR")
                            if water_to_road is None else "NAO"
                        )
                    ),
                    decision,
                ])

        if NOTA_ONLY:
            # V48: modo somente nota -- nao apaga nem desenha nada, le o que ja existe.
            created_plan_rows, nota_servico_rows, existing_count = nota_from_existing(
                db, tr, alignment, surface, side_profiles
            )
            if existing_count == 0:
                NOTA_ERRORS.append(
                    "Modo somente nota: nenhuma polilinha encontrada em layer VALETA_* / *VPAC* / *VPCC*."
                )
        else:
            groups_by_side = {}
            for side in ["LE", "LD"]:
                groups_by_side[side] = packages_by_connected_valeta(side_profiles[side])
            created_lines, created_outlets, removed_lines, created_plan_rows, debug_package_rows, nota_servico_rows = create_polylines(
                db, tr, groups_by_side
            )
        tr.Commit()
    except Exception:
        tr.Abort()
        raise
    finally:
        tr.Dispose()
except Exception as exc:
    errors.append(str(exc))

folder = os.path.dirname(CSV_INPUT) if CSV_INPUT else ""
base = os.path.splitext(os.path.basename(CSV_INPUT))[0] if CSV_INPUT else "taludes"
csv_output = os.path.join(folder, base + "_analise_valetas.csv") if folder else ""
status_output = os.path.join(folder, base + "_analise_valetas_status.txt") if folder else ""
lines_output = os.path.join(folder, base + "_valetas_criadas.csv") if folder else ""
plan_output = os.path.join(folder, base + "_valetas_planilha_base.csv") if folder else ""
debug_output = os.path.join(folder, base + "_valetas_pacotes_debug.csv") if folder else ""
nota_output = os.path.join(folder, base + "_nota_servico_valetas.csv") if folder else ""

errors.extend(NOTA_ERRORS)
nota_status = ""
if nota_output:
    # V47: grava sempre (mesmo so com cabecalho) para ficar claro se rodou.
    try:
        with open(nota_output, "wb") as stream:
            # Excel Brasil: separador ";" e decimal com virgula (fmt ja usa virgula).
            writer = csv.writer(stream, delimiter=";")
            writer.writerow(NOTA_SERVICO_HEADERS)
            writer.writerows(nota_servico_rows)
        nota_status = nota_output + " (" + str(len(nota_servico_rows)) + " dispositivos)"
    except Exception as exc:
        nota_status = "ERRO: " + str(exc)
        errors.append("Erro ao gravar nota de servico: " + str(exc))

if rows and csv_output:
    try:
        with open(csv_output, "wb") as stream:
            writer = csv.writer(stream, delimiter=";")
            writer.writerow(headers)
            writer.writerows(rows)
    except Exception as exc:
        errors.append("Erro ao gravar resultado: " + str(exc))

if created_lines and lines_output:
    try:
        with open(lines_output, "wb") as stream:
            writer = csv.writer(stream, delimiter=";")
            writer.writerow(["tipo", "lado", "estaca_inicio", "estaca_fim", "extensao_m", "pontos", "handle"])
            writer.writerows(created_lines)
    except Exception as exc:
        errors.append("Erro ao gravar lista de valetas: " + str(exc))

if created_plan_rows and plan_output:
    try:
        with open(plan_output, "wb") as stream:
            writer = csv.writer(stream, delimiter=";")
            writer.writerow([
                "numero", "tipo_planilha", "lado", "bordo",
                "estaca_inicio_m", "estaca_fim_m", "estaca_saida_m",
                "declividade_pct", "comprimento_m", "secao_critica_m",
                "ligacao", "numero_ligacao", "dissipador", "handle"
            ])
            writer.writerows(created_plan_rows)
    except Exception as exc:
        errors.append("Erro ao gravar base da planilha: " + str(exc))

if debug_package_rows and debug_output:
    try:
        with open(debug_output, "wb") as stream:
            writer = csv.writer(stream, delimiter=";")
            writer.writerow([
                "lado", "pacote", "estaca_inicio_m", "estaca_fim_m", "tipo_principal",
                "estaca_saida_m", "vao_ate_proximo_m", "encosta_no_proximo",
                "saida_cai_em_outra_valeta", "desenhou_dissipador"
            ])
            writer.writerows(debug_package_rows)
    except Exception as exc:
        errors.append("Erro ao gravar debug de pacotes: " + str(exc))

try:
    if status_output:
        with open(status_output, "w") as stream:
            stream.write("ANALISE DE VALETAS DE CORTE\n")
            stream.write("Alinhamento: " + ALIGNMENT_NAME + "\n")
            stream.write("Superficie: " + SURFACE_NAME + "\n")
            stream.write("CSV entrada: " + CSV_INPUT + "\n")
            stream.write("CSV resultado: " + csv_output + "\n")
            stream.write("Modo: " + ("SOMENTE NOTA (valetas existentes, nada apagado)" if NOTA_ONLY else "DESENHO + NOTA") + "\n")
            stream.write("Nota de servico: " + (nota_status or "nao gerada (caminho vazio)") + "\n")
            stream.write("Offsets usados exatamente como vieram no CSV; valeta sempre a 3m para fora da saia.\n")
            stream.write("Convencao de altura: positivo = ATERRO, negativo = CORTE.\n")
            stream.write("Valeta de corte so recebe dissipador quando chega no primeiro trecho de aterro.\n")
            stream.write("A existencia da valeta usa water drop real nas distancias de 2m, 5m, 10m, 40m e 70m.\n")
            stream.write("O water drop aprova quando cruza a saia ou chega perto o bastante para ser capturado pela faixa da valeta.\n")
            stream.write("A captura usa distancia real (2D) ate o ponto da saia, nao projecao numa reta fixa -- evita falso positivo quando a agua se afasta da rodovia mas cruzaria essa reta por causa de curva do tracado ou trecho quase plano.\n")
            stream.write("Sao necessarios pelo menos 2 water drops positivos para aprovar a valeta, reduzindo ruido local.\n")
            stream.write("O water drop e o criterio principal de existencia da valeta, decidindo sempre que tem dado valido suficiente.\n")
            stream.write("A declividade so decide quando o water drop nao teve dado valido suficiente (menos de 3 das 5 distancias), servindo de resgate.\n")
            stream.write("So cai em revisao manual quando o water drop nao tem dado valido suficiente E a declividade tambem nao aprova.\n")
            stream.write("Se tem agua pelo water drop capturado, a valeta e desenhada; corte e estendido ate aterro quando houver saida.\n")
            stream.write("Quando a extensao entra em aterro, o desenho faz break e continua como valeta de aterro.\n")
            stream.write("Corte estende ate um aterro confirmado por agua (nao qualquer ponto so com altura positiva), sem limite de distancia -- corte so tem saida real ao chegar em aterro.\n")
            stream.write("A extensao do corte para se o caminho comecar a subir de verdade (mais de 0,50m acima do ponto mais baixo ja alcancado) -- agua nao escoa ladeira acima.\n")
            stream.write("Se nao houver nenhum aterro confirmado no sentido hidraulico descendente, o corte fica sem extensao forcada.\n")
            stream.write("Pacotes sobrepostos do mesmo tipo passam a ser fundidos antes do desenho.\n")
            stream.write("Trechos de aterro que caem dentro do corredor dominado por corte sao recortados para evitar desenho em cima do outro.\n")
            stream.write("A uniao por proximidade vale entre pacotes do mesmo tipo; corte para aterro segue pela extensao hidraulica controlada.\n")
            stream.write("Pacote curto do tipo oposto espremido entre dois corredores do mesmo tipo volta a ser absorvido.\n")
            stream.write("So entram no desenho e na planilha os segmentos com suporte direto da regra de existencia, ou o rabicho final de saida.\n")
            stream.write("A validacao de existencia continua exigindo suporte direto no segmento, sem recortar o miolo do corredor.\n")
            stream.write("Setas e dissipador usam o mesmo final hidraulico da valeta conectada.\n")
            stream.write("Quando a saida de um pacote encosta no inicio do proximo (ate " + fmt(package_touch_tolerance(), 1) + "m de vazio, agora acompanhando o IN[10] em vez do antigo fixo de 18m), nao desenha dissipador ali: a valeta e esticada ate o ponto real de inicio do proximo pacote, fechando a costura, e a vazao acumula direto no proximo trecho.\n")
            stream.write("Intervalos entre valetas de ate 60m sao unidos quando o terreno permitir.\n")
            stream.write("Extensoes mantem a mesma layer/cor da valeta inicial, sem trecho picado no meio.\n")
            stream.write("A valeta nao e mais dividida por ponto alto ou ponto baixo interno do terreno.\n")
            stream.write("A continuidade do trecho com water drop prevalece, e a decisao seguinte passa a ser unir ou dissipar.\n")
            stream.write("Pacotes vizinhos do mesmo tipo sao religados quando a distancia entre pontas for ate 40m e a diferenca de cota for ate o ruido vertical configurado.\n")
            stream.write("A haste de saida entra na mesma layer da valeta e segue unida ao tracado principal.\n")
            stream.write("O join da saida e aplicado apenas ao segmento final correspondente ao mesmo tipo da valeta.\n")
            stream.write("O join usa a ponta geometrica mais proxima da saida, sem depender de coincidencia exata entre vertices.\n")
            stream.write("Pacotes tocando no mesmo ponto tambem sao reunidos quando pertencem ao mesmo tipo de valeta.\n")
            stream.write("Setas de caimento com comprimento de 2,40m e espacamento de 30m.\n")
            stream.write("Trecho de tipo contrario menor que 40m herda o tipo dominante da valeta.\n")
            stream.write("Se houver agua para a pista, o trecho gera valeta mesmo quando for curto.\n")
            stream.write("A uniao entre trechos e uma decisao separada: se der para juntar, junta; se nao der, fecha com dissipador.\n")
            stream.write("Agua para pista: cria valeta quando pelo menos 2 water drops sao capturados pela saia/faixa da valeta.\n")
            stream.write("Trechos curtos com water drop continuam validos, e pequenos vazios podem ser absorvidos na uniao.\n")
            stream.write("Linhas analisadas: " + str(len(rows)) + "\n")
            stream.write("Pontos criar valeta de corte: " + str(len([r for r in rows if r[-1] == "CRIAR_VALETA_CORTE"])) + "\n")
            stream.write("Pontos criar valeta de aterro: " + str(len([r for r in rows if r[-1] == "CRIAR_VALETA_ATERRO"])) + "\n")
            stream.write("Polilinhas 3D criadas: " + str(len(created_lines)) + "\n")
            stream.write("Saidas/dissipadores no aterro: " + str(len(created_outlets)) + "\n")
            stream.write("Polilinhas anteriores substituidas: " + str(removed_lines) + "\n")
            stream.write("Pontos ignorados fora do dominio: " + str(len(skipped_points)) + "\n")
            stream.write("Lista de valetas: " + lines_output + "\n")
            stream.write("Base para planilha: " + plan_output + "\n")
            stream.write("Debug dos pacotes: " + debug_output + "\n")
            stream.write("Dissipador suprimido por cair sobre outra valeta: " + str(len([r for r in debug_package_rows if r[8] == "SIM"])) + "\n")
            if errors:
                stream.write("ERROS:\n" + "\n".join(errors) + "\n")
            else:
                stream.write("OK\n")
except Exception:
    pass

OUT = [headers, rows, created_lines, created_outlets, removed_lines, skipped_points, errors, csv_output, status_output, lines_output, "NOTA: " + (nota_status or "nao gerada")]
# ----------------------------------------
