# Dynamo graph Dynamo Identificador de Queda(att).dyn (Dynamo 2.5.1.7586)

string = StringInput("REDE 01")
python_script = Python(IN[0]=string)
# ---------- python_script.python (232 lines) ----------
import clr

clr.AddReference('AcMgd')
clr.AddReference('AcDbMgd')
clr.AddReference('AeccDbMgd')

from Autodesk.AutoCAD.ApplicationServices import Application
from Autodesk.AutoCAD.DatabaseServices import *
from Autodesk.Civil.DatabaseServices import *

doc = Application.DocumentManager.MdiActiveDocument
db = doc.Database

# Nome da rede vindo do String conectado ao IN[0]
nome_rede_alvo = IN[0]

resultados = []

with doc.LockDocument():

    tr = db.TransactionManager.StartTransaction()

    try:

        bt = tr.GetObject(
            db.BlockTableId,
            OpenMode.ForRead
        )

        ms = tr.GetObject(
            bt[BlockTableRecord.ModelSpace],
            OpenMode.ForRead
        )

        for objId in ms:

            obj = tr.GetObject(
                objId,
                OpenMode.ForRead
            )

            # Somente Structures
            if not isinstance(obj, Structure):
                continue

            estrutura = obj
            nome_estrutura = estrutura.Name

            # -----------------------------------------
            # IDENTIFICAR A REDE
            # -----------------------------------------

            try:

                network = tr.GetObject(
                    estrutura.NetworkId,
                    OpenMode.ForRead
                )

                nome_rede = network.Name

            except:
                continue

            # Filtra pela rede informada no IN[0]
            if nome_rede != nome_rede_alvo:
                continue

            entradas = []
            saidas = []

            qtd = estrutura.ConnectedPipesCount

            # -----------------------------------------
            # PIPES CONECTADAS
            # -----------------------------------------

            for i in range(qtd):

                pipeId = estrutura.ConnectedPipe[i]

                pipe = tr.GetObject(
                    pipeId,
                    OpenMode.ForRead
                )

                if not isinstance(pipe, Pipe):
                    continue

                # Extremidade da pipe conectada ao PV
                if pipe.StartStructureId == estrutura.ObjectId:

                    extremo = "START"
                    elev_centro = pipe.StartPoint.Z

                elif pipe.EndStructureId == estrutura.ObjectId:

                    extremo = "END"
                    elev_centro = pipe.EndPoint.Z

                else:
                    continue

                # Cota de fundo
                invert = elev_centro - (pipe.InnerHeight / 2.0)

                # Pipe entrando ou saindo
                entrando = estrutura.IsConnectedPipeFlowingIn(i)

                dados_pipe = [
                    pipe.Name,
                    extremo,
                    invert
                ]

                if entrando:
                    entradas.append(dados_pipe)
                else:
                    saidas.append(dados_pipe)

            # -----------------------------------------
            # CALCULAR QUEDA
            # -----------------------------------------

            if len(entradas) == 1 and len(saidas) == 1:

                inv_entrada = entradas[0][2]
                inv_saida = saidas[0][2]

                queda = inv_entrada - inv_saida

                # Eliminar pequenos resíduos numéricos
                if abs(queda) < 0.0005:
                    queda = 0.0

                queda = round(queda, 3)

                # Abre Structure para escrita
                estrutura.UpgradeOpen()

                # -----------------------------------------
                # ACESSAR O MATERIAL VIA PART DATA
                # -----------------------------------------

                part_data = estrutura.PartData

                material_field = part_data.GetDataFieldBy(
                    PartContextType.Material
                )

                # -----------------------------------------
                # GRAVAR QUEDA NO MATERIAL
                # -----------------------------------------

                if queda == 0.0:

                    material_field.Value = ""

                else:

                    material_field.Value = (
                        "QUEDA: {:.3f}m".format(queda)
                    )

                # IMPORTANTE:
                # reatribuir PartData à Structure
                estrutura.PartData = part_data

                resultados.append([
                    nome_rede,
                    nome_estrutura,

                    "ENTRADA",
                    entradas[0][0],
                    round(inv_entrada, 3),

                    "SAIDA",
                    saidas[0][0],
                    round(inv_saida, 3),

                    "QUEDA",
                    queda,

                    "MATERIAL",
                    material_field.Value
                ])

            else:

                # Sem uma entrada + uma saída:
                # deixa Material vazio
                estrutura.UpgradeOpen()

                try:

                    part_data = estrutura.PartData

                    material_field = part_data.GetDataFieldBy(
                        PartContextType.Material
                    )

                    material_field.Value = ""

                    estrutura.PartData = part_data

                except:
                    pass

                resultados.append([
                    nome_rede,
                    nome_estrutura,
                    "Entradas: " + str(len(entradas)),
                    "Saidas: " + str(len(saidas)),
                    "Não calculado"
                ])

        tr.Commit()

    except Exception as e:

        tr.Abort()

        resultados = [
            "ERRO:",
            str(e)
        ]

    finally:

        tr.Dispose()

OUT = resultados
# ----------------------------------------
watch = Watch(python_script)
