# Dynamo graph DUP_FAIXA.dyn (Dynamo 2.5.1.7586)

current = Autodesk.AutoCAD.DynamoNodes.Document.Current()
boolean = BoolSelector(true)
number = DoubleInput(1000000)
string_prefixo = StringInput("AL")
number_inicio = DoubleInput(1)
number_fim = DoubleInput(3)
string_modo_todos_pares_impares = StringInput("IMPARES")
python_buscar_alinhamentos_via = Python(IN_0_prefixo=string_prefixo, IN_1_inicio=number_inicio, IN_2_fim=number_fim, IN_3_modo=string_modo_todos_pares_impares)  # "Python - Buscar alinhamentos via API Civil"
# ---------- python_buscar_alinhamentos_via.python (234 lines) ----------
import clr
import math

clr.AddReference('ProtoGeometry')
from Autodesk.DesignScript.Geometry import Point, Vector, CoordinateSystem

# Civil 3D / AutoCAD API. Esta rotina evita os nos AlignmentByName e
# Alignment.Stations do Dynamo, que podem falhar em alinhamentos copiados.
try:
    clr.AddReference('AcMgd')
    clr.AddReference('AcDbMgd')
    clr.AddReference('AeccDbMgd')
except:
    pass

from Autodesk.AutoCAD.ApplicationServices import Application
from Autodesk.AutoCAD.DatabaseServices import OpenMode
from Autodesk.Civil.ApplicationServices import CivilApplication

prefixo = IN[0]
inicio = int(IN[1])
fim = int(IN[2])
modo = IN[3]

if prefixo is None:
    prefixo = 'AL'
prefixo = str(prefixo).strip()

if modo is None:
    modo = 'TODOS'
modo = str(modo).strip().upper()
if modo in ['IMPAR', 'IMPARES', '?MPAR', '?MPARES']:
    filtro = 'IMPARES'
elif modo in ['PAR', 'PARES']:
    filtro = 'PARES'
else:
    filtro = 'TODOS'

numero_inicial = 2
tol = 0.01

pts=[]
nomes=[]
descricoes=[]
stations_filtradas_total=[]
coordinate_systems=[]
angulos_perp_rad=[]
angulos_perp_graus=[]
coords_ne=[]
origem_alinhamento=[]
avisos=[]
indices_ultimo_alinhamento=[]


def normalizar_nome(s):
    return str(s).strip().upper()


def nomes_desejados():
    wanted=[]
    step = 1 if inicio <= fim else -1
    n = inicio
    while (step > 0 and n <= fim) or (step < 0 and n >= fim):
        incluir = False
        if filtro == 'TODOS':
            incluir = True
        elif filtro == 'PARES' and n % 2 == 0:
            incluir = True
        elif filtro == 'IMPARES' and abs(n % 2) == 1:
            incluir = True
        if incluir:
            wanted.append('{} {}'.format(prefixo, n))
        n += step
    return wanted


def get_numeric(obj, names):
    for name in names:
        try:
            v = getattr(obj, name)
            if callable(v):
                v = v()
            if v is not None:
                return float(v)
        except:
            pass
    return None


def add_unique(vals, v):
    if v is None:
        return
    try:
        v = float(v)
    except:
        return
    for e in vals:
        if abs(e - v) <= tol:
            return
    vals.append(v)


def alignment_stations(al):
    vals=[]
    add_unique(vals, get_numeric(al, ['StartingStation','StartStation','StationStart','BeginStation']))
    add_unique(vals, get_numeric(al, ['EndingStation','EndStation','StationEnd','FinishStation']))

    # Tenta pegar inicios/fins das entidades internas do alinhamento.
    try:
        ents = al.Entities
        for ent in ents:
            add_unique(vals, get_numeric(ent, ['StartingStation','StartStation','StationStart','BeginStation']))
            add_unique(vals, get_numeric(ent, ['EndingStation','EndStation','StationEnd','FinishStation']))
    except Exception as e:
        pass

    vals.sort()
    return vals


def point_location(al, sta, off):
    # Civil 3D .NET usa out/ref para easting/northing. Testa assinaturas comuns.
    try:
        e = clr.Reference[float](0.0)
        n = clr.Reference[float](0.0)
        al.PointLocation(float(sta), float(off), e, n)
        return float(e.Value), float(n.Value)
    except:
        pass
    try:
        e = clr.Reference[float](0.0)
        n = clr.Reference[float](0.0)
        bearing = clr.Reference[float](0.0)
        al.PointLocation(float(sta), float(off), e, n, bearing)
        return float(e.Value), float(n.Value)
    except Exception as ex:
        avisos.append('PointLocation falhou na estaca {}: {}'.format(sta, ex))
        return None


def tangent_angle(al, sta):
    # Aproxima tangente por diferenca pequena ao longo da estaca.
    delta = 0.10
    p0 = point_location(al, sta, 0.0)
    p1 = point_location(al, sta + delta, 0.0)
    if p1 is None:
        p1 = point_location(al, sta - delta, 0.0)
        if p1 is not None and p0 is not None:
            return math.atan2(p0[1]-p1[1], p0[0]-p1[0])
    if p0 is not None and p1 is not None:
        return math.atan2(p1[1]-p0[1], p1[0]-p0[0])
    return 0.0


def adicionar_ponto(al, sta, indice_alinhamento, ultimo_indice):
    loc = point_location(al, sta, 0.0)
    if loc is None:
        return False
    x, y = loc
    ang = tangent_angle(al, sta)
    vx = Vector.ByCoordinates(math.cos(ang), math.sin(ang), 0)
    vy = Vector.ByCoordinates(-math.sin(ang), math.cos(ang), 0)
    cs = CoordinateSystem.ByOriginVectors(Point.ByCoordinates(x, y, 0), vx, vy)

    numero = len(nomes) + numero_inicial
    pts.append(Point.ByCoordinates(x, y, 0))
    coordinate_systems.append(cs)
    stations_filtradas_total.append(sta)
    origem_alinhamento.append(indice_alinhamento)
    if indice_alinhamento == ultimo_indice:
        indices_ultimo_alinhamento.append(len(nomes))

    angle_base = ang
    angulos_perp_rad.append(angle_base)
    angulos_perp_graus.append(math.degrees(angle_base))
    nomes.append('Ponto {}'.format(numero))
    descricoes.append('Ponto {}'.format(numero))
    coords_ne.append([y, x])
    return True


def processar():
    doc = Application.DocumentManager.MdiActiveDocument
    db = doc.Database
    civdoc = CivilApplication.ActiveDocument
    wanted = nomes_desejados()
    wanted_norm = dict((normalizar_nome(n), n) for n in wanted)

    tr = db.TransactionManager.StartTransaction()
    try:
        found = {}
        ids = civdoc.GetAlignmentIds()
        for oid in ids:
            try:
                al = tr.GetObject(oid, OpenMode.ForRead)
                nm = normalizar_nome(al.Name)
                if nm in wanted_norm:
                    found[nm] = al
            except Exception as e:
                pass

        ultimo_indice = len(wanted)
        for idx, nm_original in enumerate(wanted):
            nm = normalizar_nome(nm_original)
            al = found.get(nm)
            if al is None:
                avisos.append('Nao encontrou alinhamento: {}'.format(nm_original))
                continue
            stas = alignment_stations(al)
            if len(stas) == 0:
                avisos.append('Alinhamento sem estacas legiveis: {}'.format(nm_original))
                continue
            criou = 0
            for sta in stas:
                if adicionar_ponto(al, sta, idx + 1, ultimo_indice):
                    criou += 1
            if criou == 0:
                avisos.append('Encontrou {}, mas nao criou pontos.'.format(nm_original))
        tr.Commit()
    except Exception as e:
        avisos.append('Erro geral API Civil: {}'.format(e))
        try:
            tr.Abort()
        except:
            pass

processar()

if len(indices_ultimo_alinhamento) > 0:
    idx_ultimo = indices_ultimo_alinhamento[-1]
    nomes[idx_ultimo] = 'Ponto 1'
    descricoes[idx_ultimo] = 'Ponto 1'

OUT=[pts, nomes, descricoes, stations_filtradas_total, coordinate_systems, angulos_perp_rad, angulos_perp_graus, coords_ne, origem_alinhamento, avisos]
# ----------------------------------------
number_2 = DoubleInput(0)
pontos_de_geometria_para_civil = List.GetItemAtIndex(list=python_buscar_alinhamentos_via, index=number_2)
watch_pontos_de_geometria = Watch(input=pontos_de_geometria_para_civil)  # graph output
string = StringInput("0")
current_2 = Autodesk.AutoCAD.DynamoNodes.Document.Current()
number_3 = DoubleInput(1)
getItemAtIndex = List.GetItemAtIndex(list=python_buscar_alinhamentos_via, index=number_3)
number_4 = DoubleInput(2)
getItemAtIndex_2 = List.GetItemAtIndex(list=python_buscar_alinhamentos_via, index=number_4)
saida_civil_3d_cogo_points = Autodesk.Civil.DynamoNodes.CogoPoint.ByGeometry(geometry=pontos_de_geometria_para_civil, layer=string, document=current_2, name=getItemAtIndex, rawDescription=getItemAtIndex_2)  # graph output
ajustar_labels_perpendiculares = Python(IN[0]=saida_civil_3d_cogo_points, IN[1]=python_buscar_alinhamentos_via)  # graph output
# ---------- ajustar_labels_perpendiculares.python (184 lines) ----------
import clr
import math

clr.AddReference('AcMgd')
clr.AddReference('AcDbMgd')
clr.AddReference('AcCoreMgd')
from Autodesk.AutoCAD.ApplicationServices import Application
from Autodesk.AutoCAD.DatabaseServices import OpenMode
from Autodesk.AutoCAD.Geometry import Point3d, Vector3d

cogos = IN[0]
data = IN[1]

deslocamento_label = 0.0
deslocamento_ao_longo = -18.0
rotacao_extra_graus = 90.0
manter_texto_legivel = True

def as_list(value):
    if value is None:
        return []
    if isinstance(value, list):
        return value
    try:
        return list(value)
    except:
        return [value]

def get_object_id(obj):
    if obj is None:
        return None

    for attr in ["InternalDBObject", "InternalObject", "InternalDBObjectId", "InternalObjectId", "ObjectId"]:
        try:
            v = getattr(obj, attr)
            if callable(v):
                v = v()
            if v is None:
                continue
            try:
                if hasattr(v, "ObjectId"):
                    return v.ObjectId
            except:
                pass
            try:
                # ObjectId usually has IsNull.
                if hasattr(v, "IsNull"):
                    return v
            except:
                pass
        except:
            pass

    return None

def try_set_label(cogo, label_pt, offset_vec, angle):
    moved = False
    rotated = False

    try:
        cogo.IsLabelDragged = True
    except:
        pass

    for prop, val in [
        ("LabelLocation", label_pt),
        ("LabelPosition", label_pt),
        ("LabelDraggedOffset", offset_vec),
        ("DraggedLabelOffset", offset_vec),
        ("LabelOffset", offset_vec)
    ]:
        try:
            setattr(cogo, prop, val)
            moved = True
            break
        except:
            pass

    for method, val in [
        ("SetLabelLocation", label_pt),
        ("SetLabelPosition", label_pt),
        ("SetLabelDraggedOffset", offset_vec)
    ]:
        if moved:
            break
        try:
            getattr(cogo, method)(val)
            moved = True
            break
        except:
            pass

    for prop in ["LabelRotation", "Rotation", "LabelTextRotation"]:
        try:
            setattr(cogo, prop, angle)
            rotated = True
            break
        except:
            pass

    for method in ["SetLabelRotation", "SetRotation"]:
        if rotated:
            break
        try:
            getattr(cogo, method)(angle)
            rotated = True
            break
        except:
            pass

    return moved, rotated

cogo_list = as_list(cogos)
pts = as_list(data[0]) if len(data) > 0 else []
angles = as_list(data[5]) if len(data) > 5 else []
nomes = as_list(data[1]) if len(data) > 1 else []

acad_doc = Application.DocumentManager.MdiActiveDocument
avisos = []
ajustados = 0

if acad_doc is None:
    OUT = "Documento AutoCAD ativo nao encontrado."
else:
    lock = acad_doc.LockDocument()
    tr = acad_doc.Database.TransactionManager.StartTransaction()
    try:
        total = min(len(cogo_list), len(pts), len(angles))
        for i in range(total):
            oid = get_object_id(cogo_list[i])
            if oid is None:
                avisos.append("Sem ObjectId para item {}".format(i + 1))
                continue

            cogo = tr.GetObject(oid, OpenMode.ForWrite)
            x = pts[i].X
            y = pts[i].Y
            angle_base = angles[i]
            angle = angle_base + math.radians(rotacao_extra_graus)

            # Espelha a leitura quando a rotacao cair de cabeca para baixo.
            if manter_texto_legivel:
                angle_norm = angle % (2.0 * math.pi)
                if angle_norm > (math.pi / 2.0) and angle_norm < (3.0 * math.pi / 2.0):
                    angle = angle + math.pi

            # Primeiro afasta perpendicularmente ao alinhamento.
            dx = math.cos(angle_base) * deslocamento_label
            dy = math.sin(angle_base) * deslocamento_label

            # Depois afasta tambem na direcao do alinhamento, para tirar a label do miolo.
            angle_alinhamento = angle_base - (math.pi / 2.0)
            dx += math.cos(angle_alinhamento) * deslocamento_ao_longo
            dy += math.sin(angle_alinhamento) * deslocamento_ao_longo
            label_pt = Point3d(x + dx, y + dy, 0)
            offset_vec = Vector3d(dx, dy, 0)

            if i < len(nomes):
                for prop in ["Name", "PointName"]:
                    try:
                        setattr(cogo, prop, nomes[i])
                        break
                    except:
                        pass
                try:
                    cogo.RawDescription = nomes[i]
                except:
                    pass

            moved, rotated = try_set_label(cogo, label_pt, offset_vec, angle)
            if moved or rotated:
                ajustados += 1
            if not moved:
                avisos.append("{}: label nao moveu".format(i + 1))
            if not rotated:
                avisos.append("{}: label nao girou".format(i + 1))

        tr.Commit()
        OUT = "Labels ajustadas em {} de {} COGO Points. Rotacao extra: {} graus anti-horario; leitura espelhada: {}. {}".format(ajustados, total, rotacao_extra_graus, manter_texto_legivel, " | ".join(avisos[:8]))
    except Exception as ex:
        OUT = "Erro ao ajustar labels: {}".format(ex)
    finally:
        tr.Dispose()
        lock.Dispose()
# ----------------------------------------
watch_ajuste_labels = Watch(input=ajustar_labels_perpendiculares)
