# Dynamo graph Fluxo Dynamo Desap.dyn (Dynamo 2.5.1.7586)

string = StringInput("Alignment - (2) (1)")
current = Autodesk.AutoCAD.DynamoNodes.Document.Current()
alignmentByName = Autodesk.Civil.DynamoNodes.Selection.AlignmentByName(name=string, document=current)
number = DoubleInput(1000000)
boolean = BoolSelector(true)
stations = Autodesk.Civil.DynamoNodes.Alignment.Stations(alignment=alignmentByName, interval=number, includeGeometryStations=boolean)
python_script = Python(IN[0]=alignmentByName, IN[1]=stations)
# ---------- python_script.python (50 lines) ----------
import clr

clr.AddReference('ProtoGeometry')
from Autodesk.DesignScript.Geometry import Point

alignment = IN[0]
stations = IN[1]

tol = 0.01

# Filtragem
stations_filtradas = []

for i in range(len(stations)):

    if i == 0 or i == len(stations)-1:
        stations_filtradas.append(stations[i])
        continue

    prev_sta = stations[i-1]
    curr_sta = stations[i]
    next_sta = stations[i+1]

    midpoint = (prev_sta + next_sta)/2.0

    if abs(curr_sta - midpoint) > tol:
        stations_filtradas.append(curr_sta)

# Geração dos dados
pts = []
nomes = []
descricoes = []

for i, sta in enumerate(stations_filtradas):

    cs = alignment.CoordinateSystemByStationOffset(sta,0)

    pts.append(
        Point.ByCoordinates(
            cs.Origin.X,
            cs.Origin.Y,
            0
        )
    )

    nomes.append("P{}".format(i+2))

    descricoes.append("Ponto {}".format(i+2))

OUT = [pts, nomes, descricoes]
# ----------------------------------------
number_2 = DoubleInput(0)
getItemAtIndex = List.GetItemAtIndex(list=python_script, index=number_2)
string_2 = StringInput("0")
current_2 = Autodesk.AutoCAD.DynamoNodes.Document.Current()
number_3 = DoubleInput(1)
getItemAtIndex_2 = List.GetItemAtIndex(list=python_script, index=number_3)
number_4 = DoubleInput(2)
getItemAtIndex_3 = List.GetItemAtIndex(list=python_script, index=number_4)
byGeometry = Autodesk.Civil.DynamoNodes.CogoPoint.ByGeometry(geometry=getItemAtIndex, layer=string_2, document=current_2, name=getItemAtIndex_2, rawDescription=getItemAtIndex_3)
string_3 = StringInput("EIXO_GO-484-Left-40.000")
current_3 = Autodesk.AutoCAD.DynamoNodes.Document.Current()
alignmentByName_2 = Autodesk.Civil.DynamoNodes.Selection.AlignmentByName(name=string_3, document=current_3)
number_5 = DoubleInput(1000000)
boolean_2 = BoolSelector(true)
stations_2 = Autodesk.Civil.DynamoNodes.Alignment.Stations(alignment=alignmentByName_2, interval=number_5, includeGeometryStations=boolean_2)
python_script_2 = Python(IN[0]=alignmentByName_2, IN[1]=stations_2)  # same code as python_script
number_6 = DoubleInput(0)
getItemAtIndex_4 = List.GetItemAtIndex(list=python_script_2, index=number_6)
string_4 = StringInput("0")
current_4 = Autodesk.AutoCAD.DynamoNodes.Document.Current()
number_7 = DoubleInput(1)
getItemAtIndex_5 = List.GetItemAtIndex(list=python_script_2, index=number_7)
number_8 = DoubleInput(2)
getItemAtIndex_6 = List.GetItemAtIndex(list=python_script_2, index=number_8)
byGeometry_2 = Autodesk.Civil.DynamoNodes.CogoPoint.ByGeometry(geometry=getItemAtIndex_4, layer=string_4, document=current_4, name=getItemAtIndex_5, rawDescription=getItemAtIndex_6)
string_5 = StringInput("Alignment - (4) (3)")
current_5 = Autodesk.AutoCAD.DynamoNodes.Document.Current()
alignmentByName_3 = Autodesk.Civil.DynamoNodes.Selection.AlignmentByName(name=string_5, document=current_5)
number_9 = DoubleInput(1000000)
boolean_3 = BoolSelector(true)
stations_3 = Autodesk.Civil.DynamoNodes.Alignment.Stations(alignment=alignmentByName_3, interval=number_9, includeGeometryStations=boolean_3)
python_script_3 = Python(IN[0]=alignmentByName_3, IN[1]=stations_3)  # same code as python_script
number_10 = DoubleInput(0)
getItemAtIndex_7 = List.GetItemAtIndex(list=python_script_3, index=number_10)
string_6 = StringInput("0")
current_6 = Autodesk.AutoCAD.DynamoNodes.Document.Current()
number_11 = DoubleInput(1)
getItemAtIndex_8 = List.GetItemAtIndex(list=python_script_3, index=number_11)
number_12 = DoubleInput(2)
getItemAtIndex_9 = List.GetItemAtIndex(list=python_script_3, index=number_12)
byGeometry_3 = Autodesk.Civil.DynamoNodes.CogoPoint.ByGeometry(geometry=getItemAtIndex_7, layer=string_6, document=current_6, name=getItemAtIndex_8, rawDescription=getItemAtIndex_9)
string_7 = StringInput("EIXO_GO-484-Left-40.000 (1)")
current_7 = Autodesk.AutoCAD.DynamoNodes.Document.Current()
alignmentByName_4 = Autodesk.Civil.DynamoNodes.Selection.AlignmentByName(name=string_7, document=current_7)
number_13 = DoubleInput(1000000)
boolean_4 = BoolSelector(true)
stations_4 = Autodesk.Civil.DynamoNodes.Alignment.Stations(alignment=alignmentByName_4, interval=number_13, includeGeometryStations=boolean_4)
python_script_4 = Python(IN[0]=alignmentByName_4, IN[1]=stations_4)  # same code as python_script
number_14 = DoubleInput(0)
getItemAtIndex_10 = List.GetItemAtIndex(list=python_script_4, index=number_14)
string_8 = StringInput("0")
current_8 = Autodesk.AutoCAD.DynamoNodes.Document.Current()
number_15 = DoubleInput(1)
getItemAtIndex_11 = List.GetItemAtIndex(list=python_script_4, index=number_15)
number_16 = DoubleInput(2)
getItemAtIndex_12 = List.GetItemAtIndex(list=python_script_4, index=number_16)
byGeometry_4 = Autodesk.Civil.DynamoNodes.CogoPoint.ByGeometry(geometry=getItemAtIndex_10, layer=string_8, document=current_8, name=getItemAtIndex_11, rawDescription=getItemAtIndex_12)
